# Dynamo graph Complexity Representation Script.dyn "Complexity 9 (New GroupDepth and GroupWidth Logics)" (Dynamo 2.5.0.7460)
# packages: Clockwork for Dynamo 2.x 2.3.0

# group: Select Doors, Windows, Stairs, Ramps, and Model Groups
categories = Categories("OST_Doors")
categories_2 = Categories("OST_Windows")
categories_3 = Categories("OST_Stairs")
categories_4 = Categories("OST_Ramps")
categories_5 = Categories("OST_IOSModelGroups")
list_create = List.Create(item0=categories, item1=categories_2, item2=categories_3, item3=categories_4, item4=categories_5)
views = Views("QAFs Representation")
all_elements_of_category_in_view = ElementsOfCategoryInView(Category=list_create, View=views)

# group: Remove Instances without TypeOfComponent value
elementType = Element.ElementType(element=all_elements_of_category_in_view@L1)
string = StringInput("TypeOfComponent")
getParameterValueByName = Element.GetParameterValueByName(element=elementType, parameterName=string)
string_2 = StringInput("")
ne = getParameterValueByName != string_2
filterByBoolMask = List.FilterByBoolMask(list=all_elements_of_category_in_view, mask=ne)

# group: Select Curtain Walls
categories_6 = Categories("OST_Walls")
views_2 = Views("QAFs Representation")
all_elements_of_category_in_view_2 = ElementsOfCategoryInView(Category=categories_6, View=views_2)

# group: Include only CurtainWalls
elementType_2 = Element.ElementType(element=all_elements_of_category_in_view_2)
string_3 = StringInput("TypeOfComponent")
getParameterValueByName_2 = Element.GetParameterValueByName(element=elementType_2, parameterName=string_3)
string_4 = StringInput("CurtainWall")
eq = getParameterValueByName_2 == string_4
filterByBoolMask_2 = List.FilterByBoolMask(list=all_elements_of_category_in_view_2, mask=eq)
list_create_2 = List.Create(item0=filterByBoolMask_2.in)

# group: All Elements(Doors, Windows, Stairs, Ramps, Model Groups, Curtain Walls)
list_join_all_elements = List.Join(list0=filterByBoolMask.in, list1=list_create_2)

# group: Reset Dec_Lvl_1 and 2 values
string_5 = StringInput("Decomposition_Lvl_1")
number = DoubleInput(-1)
setParameterByName = Element.SetParameterByName(element=list_join_all_elements, parameterName=string_5, value=number)
string_6 = StringInput("Decomposition_Lvl_2")
number_2 = DoubleInput(-1)
setParameterByName_2 = Element.SetParameterByName(element=setParameterByName, parameterName=string_6, value=number_2)

isEmpty = List.IsEmpty(list=setParameterByName_2@L2)
not_ = Not(x=isEmpty)
filterByBoolMask_3 = List.FilterByBoolMask(list=setParameterByName_2, mask=not_)

# group: Separating Stairs, Ramps, and Curtain Walls from other Instances
code_block = CodeBlock { 0; }
getItemAtIndex = List.GetItemAtIndex(list=filterByBoolMask_3.in@L2, index=code_block)
getCategory = Element.GetCategory(element=getItemAtIndex)
name = Category.Name(category=getCategory)
string_7 = StringInput("Ramps")
is_ramp = name == string_7
string_8 = StringInput("Stairs")
is_stair = name == string_8
or_ = is_ramp || is_stair
string_9 = StringInput("Walls")
is_wall = name == string_9
or_2 = or_ || is_wall
not_2 = Not(x=or_2)
list_filterbyboolmask_other = List.FilterByBoolMask(list=filterByBoolMask_3.in, mask=not_2)  # "List.FilterByBoolMask (other Instances)"
list_filterbyboolmask_ramps = List.FilterByBoolMask(list=filterByBoolMask_3.in, mask=or_2)  # "List.FilterByBoolMask (Ramps, Stairs, and Curtain Walls)"

join = List.Join(list0=list_filterbyboolmask_other.in, list1=list_filterbyboolmask_ramps.in)

# group: ALL ELEMENTS (Doors, Windows, Stairs, Ramps, Model Groups, Curtain Walls)
list_flatten_flattenedelements = List.Flatten(list=join)

# group: Get Centroids of All Elements Except (Stairs, Ramps, and Curtain Walls)
getLocation = Element.GetLocation(element=list_filterbyboolmask_other.in)
flatten = List.Flatten(list=getLocation)

# group: Calculate Centroids of Stairs, Ramps, and Curtain Walls
boundingBox = Element.BoundingBox(element=list_filterbyboolmask_ramps.in)
minPoint = BoundingBox.MinPoint(boundingBox=boundingBox)
point_x_xmin = Point.X(point=minPoint)
maxPoint = BoundingBox.MaxPoint(boundingBox=boundingBox)
point_x_xmax = Point.X(point=maxPoint)
XCentroids = CodeBlock(Xmin=point_x_xmin, Xmax=point_x_xmax) { (Xmin+Xmax)/2; }
point_y_ymin = Point.Y(point=minPoint)
point_y_ymax = Point.Y(point=maxPoint)
YCentroids = CodeBlock(Ymin=point_y_ymin, Ymax=point_y_ymax) { (Ymin+Ymax)/2; }
point_z_zmin = Point.Z(point=minPoint)
point_z_zmax = Point.Z(point=maxPoint)
ZCentroids = CodeBlock(Zmin=point_z_zmin, Zmax=point_z_zmax) { (Zmin+Zmax)/2; }
point_bycoordinates = Point.ByCoordinates(x=XCentroids, y=YCentroids, z=ZCentroids)  # "Point.ByCoordinates (CurtainWallCentroids)"
flatten_2 = List.Flatten(list=point_bycoordinates)

join_2 = List.Join(list0=flatten, list1=flatten_2)

# group: All Centeroids (Doors, Windows, Stairs, Ramps, Model Groups, Curtain Walls)
clean = List.Clean(list=join_2)

# group: All Xcoords (Doors, Windows, Stairs, Ramps, Model Groups, Curtain Walls)
X = Point.X(point=clean)

# group: Check for facade Symmetry
views_3 = Views("QAFs Representation")
string_10 = StringInput("SymmetricalFacadeInView")
getParameterValueByName_3 = Element.GetParameterValueByName(element=views_3, parameterName=string_10)
code_block_2 = CodeBlock { 1; }
eq_2 = getParameterValueByName_3 == code_block_2

# group: Calculating Xcoords of Central Axis
maximumItem = List.MaximumItem(list=X)
minimumItem = List.MinimumItem(list=X)
main_axis_x = CodeBlock(Xmin=maximumItem, Xmax=minimumItem) { (Xmin+Xmax)/2; }

# group: Xcentral vs. Xminimum According to Symmetry of Facade
if_finalaxisx = If(test=eq_2, true=main_axis_x, false=minimumItem)

# group: Final Element and Centroids for Analysis
code_block_3 = CodeBlock(AxisX=if_finalaxisx) { AxisX-0.5; }
compare_xelements_with_xaxis = X >= code_block_3
list_filterbyboolmask_all = List.FilterByBoolMask(list=list_flatten_flattenedelements, mask=compare_xelements_with_xaxis)  # "List.FilterByBoolMask (All Elements on the Right)"
list_filterbyboolmask_all_2 = List.FilterByBoolMask(list=clean, mask=compare_xelements_with_xaxis)  # "List.FilterByBoolMask (All centroids on the Right)"

# group: ALL X, Y, Z Coordinates
Y = Point.Y(point=list_filterbyboolmask_all_2.in)
X_2 = Point.X(point=list_filterbyboolmask_all_2.in)
Z = Point.Z(point=list_filterbyboolmask_all_2.in)

# group: GroupDepth Threshold
number_groupdepth = DoubleInput(1)

# group: Grouping of Recess and Protrusion by "GroupDepth"
sortByKey = List.SortByKey(list=list_filterbyboolmask_all.in, keys=Y)
add = _ + _  # unwired: x, y
number_3 = DoubleInput(0)
number_4 = DoubleInput(1)
list_dropitems_next_y = List.DropItems(list=sortByKey.sorted_keys, amount=number_4)
count = List.Count(list=sortByKey.sorted_keys)
code_block_4 = CodeBlock(ListCount=count) { ListCount-1; }
list_takeitems_current_y = List.TakeItems(list=sortByKey.sorted_keys, amount=code_block_4)
depth_gaps = list_dropitems_next_y - list_takeitems_current_y
new_group = depth_gaps > number_groupdepth
number_5 = DoubleInput(1)
number_6 = DoubleInput(0)
if_group_increment = If(test=new_group, true=number_5, false=number_6)
scan = ScanList(reductor=add, seed=number_3, list1=if_group_increment)  # "List.Scan"

list_sortbykey_point_x_sorted_by = List.SortByKey(list=X_2, keys=Y)  # "List.SortByKey (Point X Sorted by Y)"

# group: GroupWidth Threshold
number_groupwidth = DoubleInput(4)

list_sortbykey_point_z_sorted_by = List.SortByKey(list=Z, keys=Y)  # "List.SortByKey (Point Z Sorted by Y)"

# group: Depth Groups (Elements, Xcoords, Zcoords)
list_groupbykey_ygroupedelements = List.GroupByKey(list=sortByKey.sorted_list, keys=scan)
list_groupbykey_y = List.GroupByKey(list=list_sortbykey_point_x_sorted_by.sorted_list, keys=scan)  # "List.GroupByKey (Y_GroupedCentroidX)"
list_groupbykey_y_2 = List.GroupByKey(list=list_sortbykey_point_z_sorted_by.sorted_list, keys=scan)  # "List.GroupByKey (Y_GroupedCentroidZ)"

# group: Remove Depth Groups with one Instance
count_2 = List.Count(list=list_groupbykey_ygroupedelements.groups@L2)
code_block_5 = CodeBlock { 1; }
gt = count_2 > code_block_5
list_filterbyboolmask = List.FilterByBoolMask(list=list_groupbykey_ygroupedelements.groups, mask=gt)  # "List.FilterByBoolMask (YGroupedElements)"
count_3 = List.Count(list=list_groupbykey_y.groups@L2)
gt_2 = count_3 > code_block_5
list_filterbyboolmask_y = List.FilterByBoolMask(list=list_groupbykey_y.groups, mask=gt_2)  # "List.FilterByBoolMask (Y_GroupedCentroidX)"
count_4 = List.Count(list=list_groupbykey_y_2.groups@L2)
gt_3 = count_4 > code_block_5
list_filterbyboolmask_y_2 = List.FilterByBoolMask(list=list_groupbykey_y_2.groups, mask=gt_3)  # "List.FilterByBoolMask (Y_GroupedCentroidZ)"

# group: Grouping of Masses by "Group Width"
sortByKey_2 = List.SortByKey(list=list_filterbyboolmask.in@L2, keys=list_filterbyboolmask_y.in@L2)
number_7 = DoubleInput(1)
list_dropitems_next_x = List.DropItems(list=sortByKey_2.sorted_keys@L2, amount=number_7)
number_8 = DoubleInput(-1)
list_dropitems_current_x = List.DropItems(list=sortByKey_2.sorted_keys@L2, amount=number_8)
width_gaps = list_dropitems_next_x@L2 - list_dropitems_current_x@L2
new_group_2 = width_gaps@L2 > number_groupwidth
number_9 = DoubleInput(1)
number_10 = DoubleInput(0)
if_group_increment_2 = If(test=new_group_2, true=number_9, false=number_10)
cumulativeGroupKeys = Custom[CumulativeGroupKeys]()  # unwired: increments
map = List.Map(list=if_group_increment_2, f_x=cumulativeGroupKeys)

sortByKey_3 = List.SortByKey(list=list_filterbyboolmask_y_2.in@L2, keys=list_filterbyboolmask_y.in@L2)
sortByKey_4 = List.SortByKey(list=list_filterbyboolmask_y.in@L2, keys=list_filterbyboolmask_y.in@L2)

# group: Width Groups (Elements, Xcoords, Zcoords)
list_groupbykey_x = List.GroupByKey(list=sortByKey_2.sorted_list@L2, keys=map@L2)  # "List.GroupByKey (X_GroupedElements)"
list_groupbykey_x_2 = List.GroupByKey(list=sortByKey_3.sorted_list@L2, keys=map@L2)  # "List.GroupByKey (X_GroupedCentroidZ)"
list_groupbykey_x_3 = List.GroupByKey(list=sortByKey_4.sorted_list@L2, keys=map@L2)  # "List.GroupByKey (X_GroupedCentroidX)"

# group: Identifying Signatures: Structured Data Preparation
list_minimumitem_clusterminz = List.MinimumItem(list=list_groupbykey_x_2.groups)
relativez = list_groupbykey_x_2.groups - list_minimumitem_clusterminz
code_block_6 = CodeBlock { 2; }
math_round_zlist = Math.Round(number=relativez, digits=code_block_6)
list_minimumitem_clusterminx = List.MinimumItem(list=list_groupbykey_x_3.groups)
relativex = list_groupbykey_x_3.groups - list_minimumitem_clusterminx
math_round_xlist = Math.Round(number=relativex, digits=code_block_6)

# group: Sort All by relative Z value
list_sortbykey_instances_sorted = List.SortByKey(list=list_groupbykey_x.groups@L2, keys=math_round_zlist@L2)  # "List.SortByKey (Instances sorted by ZList)"
list_sortbykey_zlist_sorted_by = List.SortByKey(list=math_round_zlist@L2, keys=math_round_zlist@L2)  # "List.SortByKey (ZList sorted by ZList)"
list_sortbykey_xlist_sorted_by = List.SortByKey(list=math_round_xlist@L2, keys=math_round_zlist@L2)  # "List.SortByKey (XList sorted by ZList)"

# group: Group Instances by Z value, then sort by X value
list_groupbykey = List.GroupByKey(list=list_sortbykey_instances_sorted.sorted_list@L2, keys=list_sortbykey_zlist_sorted_by.sorted_list@L2)  # "List.GroupByKey (RelativeZGroupedInstances)"
list_groupbykey_2 = List.GroupByKey(list=list_sortbykey_xlist_sorted_by.sorted_list@L2, keys=list_sortbykey_zlist_sorted_by.sorted_list@L2)  # "List.GroupByKey (RelativeZGroupedXlist)"
sortByKey_5 = List.SortByKey(list=list_groupbykey.groups@L2, keys=list_groupbykey_2.groups@L2)
count_5 = List.Count(list=list_groupbykey_2.groups@L3)
list_chop_final_sorted_instances = List.Chop(list=sortByKey_5.sorted_list, lengths=count_5)
list_flatten_final_sorted = List.Flatten(list=list_chop_final_sorted_instances, lacing=Longest)  # "List.Flatten (Final Sorted instances)"
list_groupbykey_3 = List.GroupByKey(list=list_sortbykey_xlist_sorted_by.sorted_list@L2, keys=list_sortbykey_zlist_sorted_by.sorted_list@L2)  # "List.GroupByKey (RelativeZGroupedZlist)"
list_sort_final_sorted_x_list = List.Sort(list=list_groupbykey_3.groups)
list_flatten_final_sorted_x_list = List.Flatten(list=list_sort_final_sorted_x_list, lacing=Longest)
list_groupbykey_4 = List.GroupByKey(list=list_sortbykey_zlist_sorted_by.sorted_list@L2, keys=relativez@L2)  # "List.GroupByKey (RelativeZGroupedZlist)"
list_flatten_final_sorted_z_list = List.Flatten(list=list_groupbykey_4.groups, lacing=Longest)

# group: Identifying Signatures: Convert to String
element_elementtype = Element.ElementType(element=list_flatten_final_sorted)  # "Element.ElementType (InstanceTypesList)"
string_11 = StringInput("Type Name")
element_getparametervaluebyname = Element.GetParameterValueByName(element=element_elementtype, parameterName=string_11)  # "Element.GetParameterValueByName (NameList)"
flatten_3 = List.Flatten(list=element_getparametervaluebyname)
string_from_object = FromObject(obj=list_flatten_final_sorted_x_list)
flatten_4 = List.Flatten(list=string_from_object)
string_from_object_2 = FromObject(obj=list_flatten_final_sorted_z_list)
flatten_5 = List.Flatten(list=string_from_object_2)

# group: Identifying Signatures: Restructuring flattened Lists
string_12 = StringInput("&&")
string_13 = StringInput(",")
list_create_3 = List.Create(item0=flatten_3, item1=flatten_4, item2=flatten_5)
transpose = List.Transpose(lists=list_create_3)
join_3 = String.Join(separator=string_13, string0=transpose)
list_count_clustercounts = List.Count(list=element_getparametervaluebyname@L2)
chop = List.Chop(list=join_3@L2, lengths=list_count_clustercounts)
list_count_clustercounts_2 = List.Count(list=element_getparametervaluebyname@L3)
chop_2 = List.Chop(list=chop@L3, lengths=list_count_clustercounts_2)
code_block_7 = CodeBlock { 1; }
list_flatten = List.Flatten(list=chop_2, amt=code_block_7)  # "List.Flatten (SameStructureAsInstances)"
join_4 = String.Join(separator=string_12, string0=list_flatten)
flatten_6 = List.Flatten(list=join_4)

# group: Debug Signatures
watch = Watch(flatten_6)

maximumItem_2 = List.MaximumItem(list=list_groupbykey_x_3.groups)

# group: Identifying Mirrored Signatures: Structured Data Preparation
list_minimumitem_clusterminz_2 = List.MinimumItem(list=list_groupbykey_x_2.groups)
relativez_2 = list_groupbykey_x_2.groups - list_minimumitem_clusterminz_2
code_block_8 = CodeBlock { 2; }
math_round_zlist_2 = Math.Round(number=relativez_2, digits=code_block_8)
relativex_2 = maximumItem_2 - list_groupbykey_x_3.groups
math_round_xlist_2 = Math.Round(number=relativex_2, digits=code_block_8)

# group: Sort All by relative Z value
list_sortbykey_instances_sorted_2 = List.SortByKey(list=list_groupbykey_x.groups@L2, keys=math_round_zlist_2@L2)  # "List.SortByKey (Instances sorted by ZList)"
list_sortbykey_zlist_sorted_by_2 = List.SortByKey(list=math_round_zlist_2@L2, keys=math_round_zlist_2@L2)  # "List.SortByKey (ZList sorted by ZList)"
list_sortbykey_xlist_sorted_by_2 = List.SortByKey(list=math_round_xlist_2@L2, keys=math_round_zlist_2@L2)  # "List.SortByKey (XList sorted by ZList)"

# group: Group Instances by Z value, then sort by X value
list_groupbykey_5 = List.GroupByKey(list=list_sortbykey_instances_sorted_2.sorted_list@L2, keys=list_sortbykey_zlist_sorted_by_2.sorted_list@L2)  # "List.GroupByKey (RelativeZGroupedInstances)"
list_groupbykey_6 = List.GroupByKey(list=list_sortbykey_xlist_sorted_by_2.sorted_list@L2, keys=list_sortbykey_zlist_sorted_by_2.sorted_list@L2)  # "List.GroupByKey (RelativeZGroupedXlist)"
sortByKey_6 = List.SortByKey(list=list_groupbykey_5.groups@L2, keys=list_groupbykey_6.groups@L2)
count_6 = List.Count(list=list_groupbykey_6.groups@L3)
list_chop_final_sorted_instances_2 = List.Chop(list=sortByKey_6.sorted_list, lengths=count_6)
list_flatten_final_sorted_2 = List.Flatten(list=list_chop_final_sorted_instances_2, lacing=Longest)  # "List.Flatten (Final Sorted instances)"
list_groupbykey_7 = List.GroupByKey(list=list_sortbykey_xlist_sorted_by_2.sorted_list@L2, keys=list_sortbykey_zlist_sorted_by_2.sorted_list@L2)  # "List.GroupByKey (RelativeZGroupedZlist)"
list_sort_final_sorted_x_list_2 = List.Sort(list=list_groupbykey_7.groups)
list_flatten_final_sorted_x_list_2 = List.Flatten(list=list_sort_final_sorted_x_list_2, lacing=Longest)
list_groupbykey_8 = List.GroupByKey(list=list_sortbykey_zlist_sorted_by_2.sorted_list@L2, keys=relativez_2@L2)  # "List.GroupByKey (RelativeZGroupedZlist)"
list_flatten_final_sorted_z_list_2 = List.Flatten(list=list_groupbykey_8.groups, lacing=Longest)

# group: Identifying Mirrored Signatures: Convert to String
element_elementtype_2 = Element.ElementType(element=list_flatten_final_sorted_2)  # "Element.ElementType (InstanceTypesList)"
string_14 = StringInput("Type Name")
element_getparametervaluebyname_2 = Element.GetParameterValueByName(element=element_elementtype_2, parameterName=string_14)  # "Element.GetParameterValueByName (NameList)"
flatten_7 = List.Flatten(list=element_getparametervaluebyname_2)
string_from_object_3 = FromObject(obj=list_flatten_final_sorted_x_list_2)
flatten_8 = List.Flatten(list=string_from_object_3)
string_from_object_4 = FromObject(obj=list_flatten_final_sorted_z_list_2)
flatten_9 = List.Flatten(list=string_from_object_4)

# group: Identifying Mirrored Signatures: Restructuring flattened Lists
string_15 = StringInput("&&")
string_16 = StringInput(",")
list_create_4 = List.Create(item0=flatten_7, item1=flatten_8, item2=flatten_9)
transpose_2 = List.Transpose(lists=list_create_4)
join_5 = String.Join(separator=string_16, string0=transpose_2)
list_count_clustercounts_3 = List.Count(list=element_getparametervaluebyname_2@L2)
chop_3 = List.Chop(list=join_5@L2, lengths=list_count_clustercounts_3)
list_count_clustercounts_4 = List.Count(list=element_getparametervaluebyname_2@L3)
chop_4 = List.Chop(list=chop_3@L3, lengths=list_count_clustercounts_4)
code_block_9 = CodeBlock { 1; }
list_flatten_2 = List.Flatten(list=chop_4, amt=code_block_9)  # "List.Flatten (SameStructureAsInstances)"
join_6 = String.Join(separator=string_15, string0=list_flatten_2)
flatten_10 = List.Flatten(list=join_6)

# group: Combine Original and Mirrored Signatures
list_create_5 = List.Create(item0=flatten_10, item1=flatten_6)
transpose_3 = List.Transpose(lists=list_create_5)
sort = List.Sort(list=transpose_3@L2)
firstItem = List.FirstItem(list=sort@L2)

# group: Counting Groups of C1
uniqueItems = List.UniqueItems(list=firstItem)
count_7 = List.Count(list=uniqueItems)
watch_2 = Watch(count_7)

# group: Assign Dec_Lvl_1 value
string_17 = StringInput("Decomposition_Lvl_1")
list_indexof_idofeachgroup = List.IndexOf(list=uniqueItems, element=firstItem)
count_8 = List.Count(list=list_flatten_final_sorted@L2)
ofRepeatedItem = List.OfRepeatedItem(item=list_indexof_idofeachgroup@L1, amount=count_8@L1)
setParameterByName_3 = Element.SetParameterByName(element=list_flatten_final_sorted, parameterName=string_17, value=ofRepeatedItem)

# group: X and Z Centroids of Resulting Instances
boundingBox_2 = Element.BoundingBox(element=setParameterByName_3)
minPoint_2 = BoundingBox.MinPoint(boundingBox=boundingBox_2)
point_x_xmin_2 = Point.X(point=minPoint_2)
maxPoint_2 = BoundingBox.MaxPoint(boundingBox=boundingBox_2)
point_x_xmax_2 = Point.X(point=maxPoint_2)
XCentroids_2 = CodeBlock(Xmin=point_x_xmin_2, Xmax=point_x_xmax_2) { (Xmin+Xmax)/2; }
point_z_zmin_2 = Point.Z(point=minPoint_2)
point_z_zmax_2 = Point.Z(point=maxPoint_2)
zcentroids_instances = CodeBlock(Zmin=point_z_zmin_2, Zmax=point_z_zmax_2) { (Zmin+Zmax)/2; }

# group: Select Generic Models
categories_7 = Categories("OST_GenericModel")
views_4 = Views("QAFs Representation")
all_elements_of_category_in_view_3 = ElementsOfCategoryInView(Category=categories_7, View=views_4)

# group: Include Horizontal Extrusions and Canopies only
elementType_3 = Element.ElementType(element=all_elements_of_category_in_view_3)
string_18 = StringInput("TypeOfComponent")
getParameterValueByName_4 = Element.GetParameterValueByName(element=elementType_3, parameterName=string_18)
string_19 = StringInput("HorizontalExtrusion")
eq_3 = getParameterValueByName_4 == string_19
string_20 = StringInput("Canopy")
eq_4 = getParameterValueByName_4 == string_20
or_3 = eq_3 || eq_4
filterByBoolMask_4 = List.FilterByBoolMask(list=all_elements_of_category_in_view_3, mask=or_3)

# group: Get generic models Xmin and Xmax and ZCentroids
boundingBox_3 = Element.BoundingBox(element=filterByBoolMask_4.in)
minPoint_3 = BoundingBox.MinPoint(boundingBox=boundingBox_3)
point_x_xmin_3 = Point.X(point=minPoint_3)
maxPoint_3 = BoundingBox.MaxPoint(boundingBox=boundingBox_3)
point_x_xmax_3 = Point.X(point=maxPoint_3)
xcenter_of_horizontal_extrusion = CodeBlock(Xmin=point_x_xmin_3, Xmax=point_x_xmax_3) { (Xmin+Xmax)/2; }
point_z_zmin_3 = Point.Z(point=minPoint_3)
point_z_zmax_3 = Point.Z(point=maxPoint_3)
zcentroids_horizontalextrusions = CodeBlock(Zmin=point_z_zmin_3, Zmax=point_z_zmax_3) { (Zmin+Zmax)/2; }

# group: Group Horizontal Extrusions by Xcenter
list_sortbykey_instsorted = List.SortByKey(list=filterByBoolMask_4.in, keys=xcenter_of_horizontal_extrusion)
count_9 = List.Count(list=list_sortbykey_instsorted.sorted_list)
code_block_10 = CodeBlock(n=count_9) { n-1; }
range_indexrange = Range(end=code_block_10)
count_10 = List.Count(list=list_sortbykey_instsorted.sorted_keys)
code_block_11 = CodeBlock(n=count_10) { n-1; }
list_takeitems_headlist = List.TakeItems(list=list_sortbykey_instsorted.sorted_keys, amount=code_block_11)
code_block_12 = CodeBlock { 1; }
list_dropitems_taillist = List.DropItems(list=list_sortbykey_instsorted.sorted_keys, amount=code_block_12)
sub = list_takeitems_headlist - list_dropitems_taillist  # lacing=Shortest
abs = Math.Abs(number=sub)
code_block_13 = CodeBlock { 1; }
boolmask = abs <= code_block_13
not_3 = Not(x=boolmask)
boolean = BoolSelector(true)
code_block_14 = CodeBlock { 0; }
list_insert_maskwithstart = List.Insert(list=not_3, element=boolean, index=code_block_14)
list_filterbyboolmask_startidx = List.FilterByBoolMask(list=range_indexrange, mask=list_insert_maskwithstart)
list_additemtoend = List.AddItemToEnd(item=count_9, list=list_filterbyboolmask_startidx.in)  # "List.AddItemToEnd (startIdxPlusEnd)"
code_block_15 = CodeBlock { -1; }
list_shiftindices_endidx = List.ShiftIndices(list=list_additemtoend, amount=code_block_15)
dropItems = List.DropItems(list=list_shiftindices_endidx, amount=code_block_15)
grplengths = dropItems - list_additemtoend
chop_5 = List.Chop(list=list_sortbykey_instsorted.sorted_list, lengths=grplengths)

# group: Get generic models Xmin and Xmax and ZCentroids
boundingBox_4 = Element.BoundingBox(element=chop_5)
minPoint_4 = BoundingBox.MinPoint(boundingBox=boundingBox_4)
point_x_xmin_4 = Point.X(point=minPoint_4)
code_block_xmin_tol = CodeBlock(Xmin=point_x_xmin_4) { Xmin-0.5; }
point_z_zmin_4 = Point.Z(point=minPoint_4)
maxPoint_4 = BoundingBox.MaxPoint(boundingBox=boundingBox_4)
point_z_zmax_4 = Point.Z(point=maxPoint_4)
zcentroids_horizontalextrusions_2 = CodeBlock(Zmin=point_z_zmin_4, Zmax=point_z_zmax_4) { (Zmin+Zmax)/2; }
point_x_xmax_4 = Point.X(point=maxPoint_4)
code_block_xmax_tol = CodeBlock(Xmax=point_x_xmax_4) { Xmax+0.5; }

# group: Sort Horizontal Extrusions by Zcenters
list_sortbykey = List.SortByKey(list=code_block_xmin_tol@L2, keys=zcentroids_horizontalextrusions_2@L2)  # "List.SortByKey (FinalHExtrusionsXmins)"
list_sortbykey_2 = List.SortByKey(list=code_block_xmax_tol@L2, keys=zcentroids_horizontalextrusions_2@L2)  # "List.SortByKey (FinalHExtrusionsXmaxs)"
list_sort = List.Sort(list=zcentroids_horizontalextrusions_2)  # "List.Sort (FinalHExtrusionsZcenters)"

minimumItem_2 = List.MinimumItem(list=list_sortbykey.sorted_list@@L2)
maximumItem_3 = List.MaximumItem(list=list_sortbykey_2.sorted_list@@L2)

# group: Identify Elements within each HorizontalExtrusion
depth_group_strip_elements = XCentroids_2@@L3 >= minimumItem_2@L1  # lacing=CrossProduct
code_block_16 = CodeBlock { 1; }
flatten_11 = List.Flatten(list=depth_group_strip_elements, amt=code_block_16)
depth_group_strip_elements_2 = XCentroids_2@@L3 <= maximumItem_3@L1  # lacing=CrossProduct
code_block_17 = CodeBlock { 1; }
flatten_12 = List.Flatten(list=depth_group_strip_elements_2, amt=code_block_17)
strip_depth_group_elements = flatten_11 && flatten_12
list_filterbyboolmask_strip = List.FilterByBoolMask(list=setParameterByName_3@@L3, mask=strip_depth_group_elements@L3, lacing=Longest)  # "List.FilterByBoolMask {strip}{depth-group}{elementswithin}"
list_filterbyboolmask_z_coords = List.FilterByBoolMask(list=zcentroids_instances@@L3, mask=strip_depth_group_elements@L3, lacing=Longest)  # "List.FilterByBoolMask Z coords of instances {strip}{depth-group}{elementswithin}"

# group: Debug
watch_strip_depth_group = Watch(list_filterbyboolmask_strip.in)  # "Watch {strip}{depth-group}{elementswithin}"

# group: Debug
watch_strip_depth_group_2 = Watch(list_filterbyboolmask_z_coords.in)  # "Watch {strip}{depth-group}{elementswithin}"

# group: Debug Width Groups
count_11 = List.Count(list=list_groupbykey_x_2.groups@L3)
total_count_of_width_groups = Watch(count_11)  # "Total Count Of Width Groups Without Removing Redundant Groups"

# group: Cleanup and Flatten
isEmpty_2 = List.IsEmpty(list=list_filterbyboolmask_strip.in@@L2)
not_4 = Not(x=isEmpty_2)
filterByBoolMask_5 = List.FilterByBoolMask(list=list_filterbyboolmask_strip.in, mask=not_4)
flatten_13 = List.Flatten(list=filterByBoolMask_5.in@L3)
isEmpty_3 = List.IsEmpty(list=list_filterbyboolmask_z_coords.in@@L2)
not_5 = Not(x=isEmpty_3)
filterByBoolMask_6 = List.FilterByBoolMask(list=list_filterbyboolmask_z_coords.in, mask=not_5)
flatten_14 = List.Flatten(list=filterByBoolMask_6.in@L3)

# group: Determine Upper and Lower Bounds of Sub-Groups
flatten_15 = List.Flatten(list=flatten_14)
maximumItem_4 = List.MaximumItem(list=flatten_15)
minimumItem_3 = List.MinimumItem(list=flatten_15)
addItemToFront = List.AddItemToFront(item=minimumItem_3, list=list_sort@L2)
list_additemtoend_boundaries = List.AddItemToEnd(item=maximumItem_4, list=addItemToFront@L2)
code_block_18 = CodeBlock { -1; }
list_dropitems_lowerb = List.DropItems(list=list_additemtoend_boundaries@L2, amount=code_block_18)
list_count_lowerbcount = List.Count(list=list_dropitems_lowerb@L2)
code_block_19 = CodeBlock { -1; }
list_shiftindices_upperb = List.ShiftIndices(list=list_additemtoend_boundaries@L2, amount=code_block_19)
code_block_20 = CodeBlock { -1; }
list_dropitems_upperb = List.DropItems(list=list_shiftindices_upperb@L2, amount=code_block_20)

# group: Identifying Instances in each Sub-Group
ofRepeatedItem_2 = List.OfRepeatedItem(item=flatten_13, amount=list_count_lowerbcount, lacing=Longest)
ofRepeatedItem_3 = List.OfRepeatedItem(item=flatten_14, amount=list_count_lowerbcount, lacing=Longest)
ge = ofRepeatedItem_3@L3 >= list_dropitems_lowerb@L2  # lacing=Longest
le = ofRepeatedItem_3@L3 <= list_dropitems_upperb@L2  # lacing=Longest
and_ = ge && le
list_filterbyboolmask_2 = List.FilterByBoolMask(list=ofRepeatedItem_2, mask=and_)  # "List.FilterByBoolMask (SliceWinIDs)"

# group: Debug
watch_3 = Watch(list_filterbyboolmask_2.in)

# group: Debug Width Groups
watch_4 = Watch(list_groupbykey_x.groups)

# group: Debug Depth Groups
watch_5 = Watch(list_groupbykey_ygroupedelements.groups)

# group: Debug Horizontal Extrusions Grouping
watch_6 = Watch(chop_5)

# group: Remove Empty Lists
isEmpty_4 = List.IsEmpty(list=list_filterbyboolmask_2.in@@L2)
not_6 = Not(x=isEmpty_4@@L2)
filterByBoolMask_7 = List.FilterByBoolMask(list=list_filterbyboolmask_2.in, mask=not_6)
code_block_21 = CodeBlock { 1; }
flatten_16 = List.Flatten(list=filterByBoolMask_7.in, amt=code_block_21)

# group: Debug
watch_7 = Watch(filterByBoolMask_7.in)

# group: Read all Elements in View
categories_8 = Categories("OST_Doors")
categories_9 = Categories("OST_Windows")
categories_10 = Categories("OST_Stairs")
categories_11 = Categories("OST_Ramps")
categories_12 = Categories("OST_IOSModelGroups")
join_7 = List.Join(list0=categories_8, list1=categories_9, list2=categories_10, list3=categories_11, list4=categories_12)
views_5 = Views("QAFs Representation")
all_elements_of_category_in_view_4 = ElementsOfCategoryInView(Category=join_7, View=views_5)

# group: Read Curtain Walls in View
categories_13 = Categories("OST_Walls")
views_6 = Views("QAFs Representation")
all_elements_of_category_in_view_5 = ElementsOfCategoryInView(Category=categories_13, View=views_6)
elementType_4 = Element.ElementType(element=all_elements_of_category_in_view_5)
string_21 = StringInput("TypeOfComponent")
getParameterValueByName_5 = Element.GetParameterValueByName(element=elementType_4, parameterName=string_21)
string_22 = StringInput("CurtainWall")
eq_5 = getParameterValueByName_5 == string_22
filterByBoolMask_8 = List.FilterByBoolMask(list=all_elements_of_category_in_view_5, mask=eq_5)

# group: Combine and Flatten
join_8 = List.Join(list0=all_elements_of_category_in_view_4, list1=filterByBoolMask_8.in)
flatten_17 = List.Flatten(list=join_8)

# group: X and Z Centroids of Resulting Instances
boundingBox_5 = Element.BoundingBox(element=flatten_16)
minPoint_5 = BoundingBox.MinPoint(boundingBox=boundingBox_5)
point_z_zmin_5 = Point.Z(point=minPoint_5)
maxPoint_5 = BoundingBox.MaxPoint(boundingBox=boundingBox_5)
point_z_zmax_5 = Point.Z(point=maxPoint_5)
zcentroids_instances_2 = CodeBlock(Zmin=point_z_zmin_5, Zmax=point_z_zmax_5) { (Zmin+Zmax)/2; }
point_x_xmin_5 = Point.X(point=minPoint_5)
point_x_xmax_5 = Point.X(point=maxPoint_5)
XCentroids_3 = CodeBlock(Xmin=point_x_xmin_5, Xmax=point_x_xmax_5) { (Xmin+Xmax)/2; }

# group: Identifying Signatures: Structured Data Preparation
list_minimumitem_clusterminz_3 = List.MinimumItem(list=zcentroids_instances_2)
relativez_3 = zcentroids_instances_2 - list_minimumitem_clusterminz_3
list_minimumitem_clusterminx_2 = List.MinimumItem(list=XCentroids_3)
relativex_3 = XCentroids_3 - list_minimumitem_clusterminx_2
math_round_xlist_3 = Math.Round(number=relativex_3)
math_round_zlist_3 = Math.Round(number=relativez_3)

# group: Sort All by relative Z value
sortByKey_7 = List.SortByKey(list=flatten_16@L2, keys=relativez_3@L2)
sortByKey_8 = List.SortByKey(list=math_round_xlist_3@L2, keys=relativez_3@L2)
sortByKey_9 = List.SortByKey(list=math_round_zlist_3@L2, keys=relativez_3@L2)

# group: Group Instances by Z value, then sort by X value
list_groupbykey_9 = List.GroupByKey(list=sortByKey_7.sorted_list@L2, keys=relativez_3@L2)  # "List.GroupByKey (RelativeZGroupedInstances)"
list_groupbykey_10 = List.GroupByKey(list=relativex_3@L2, keys=relativez_3@L2)  # "List.GroupByKey (RelativeZGroupedXlist)"
sortByKey_10 = List.SortByKey(list=list_groupbykey_9.groups@L2, keys=list_groupbykey_10.groups@L2)
count_12 = List.Count(list=list_groupbykey_10.groups@L3)
list_chop_final_sorted_instances_3 = List.Chop(list=sortByKey_10.sorted_list, lengths=count_12)
list_flatten_final_sorted_3 = List.Flatten(list=list_chop_final_sorted_instances_3, lacing=Longest)  # "List.Flatten (Final Sorted instances)"
list_groupbykey_11 = List.GroupByKey(list=sortByKey_8.sorted_list@L2, keys=relativez_3@L2)  # "List.GroupByKey (RelativeZGroupedZlist)"
list_sort_final_sorted_x_list_3 = List.Sort(list=list_groupbykey_11.groups)
list_flatten_final_sorted_x_list_3 = List.Flatten(list=list_sort_final_sorted_x_list_3, lacing=Longest)
list_groupbykey_12 = List.GroupByKey(list=sortByKey_9.sorted_list@L2, keys=relativez_3@L2)  # "List.GroupByKey (RelativeZGroupedZlist)"
list_flatten_final_sorted_z_list_3 = List.Flatten(list=list_groupbykey_12.groups, lacing=Longest)

# group: Identifying Mirrored Signatures: Structured Data Preparation
list_minimumitem_clusterminz_4 = List.MinimumItem(list=zcentroids_instances_2)
relativez_4 = zcentroids_instances_2 - list_minimumitem_clusterminz_4
maximumItem_5 = List.MaximumItem(list=XCentroids_3)
relativex_4 = maximumItem_5 - XCentroids_3
math_round_xlist_4 = Math.Round(number=relativex_4)
math_round_zlist_4 = Math.Round(number=relativez_4)

# group: Sort All by relative Z value
sortByKey_11 = List.SortByKey(list=flatten_16@L2, keys=relativez_4@L2)
sortByKey_12 = List.SortByKey(list=math_round_xlist_4@L2, keys=relativez_4@L2)
sortByKey_13 = List.SortByKey(list=math_round_zlist_4@L2, keys=relativez_4@L2)

# group: Group Instances by Z value, then sort by X value
list_groupbykey_13 = List.GroupByKey(list=sortByKey_11.sorted_list@L2, keys=relativez_4@L2)  # "List.GroupByKey (RelativeZGroupedInstances)"
list_groupbykey_14 = List.GroupByKey(list=relativex_4@L2, keys=relativez_4@L2)  # "List.GroupByKey (RelativeZGroupedXlist)"
sortByKey_14 = List.SortByKey(list=list_groupbykey_13.groups@L2, keys=list_groupbykey_14.groups@L2)
count_13 = List.Count(list=list_groupbykey_14.groups@L3)
list_chop_final_sorted_instances_4 = List.Chop(list=sortByKey_14.sorted_list, lengths=count_13)
list_flatten_final_sorted_4 = List.Flatten(list=list_chop_final_sorted_instances_4, lacing=Longest)  # "List.Flatten (Final Sorted instances)"
list_groupbykey_15 = List.GroupByKey(list=sortByKey_12.sorted_list@L2, keys=relativez_4@L2)  # "List.GroupByKey (RelativeZGroupedZlist)"
list_sort_final_sorted_x_list_4 = List.Sort(list=list_groupbykey_15.groups)
list_flatten_final_sorted_x_list_4 = List.Flatten(list=list_sort_final_sorted_x_list_4, lacing=Longest)
list_groupbykey_16 = List.GroupByKey(list=sortByKey_13.sorted_list@L2, keys=relativez_4@L2)  # "List.GroupByKey (RelativeZGroupedZlist)"
list_flatten_final_sorted_z_list_4 = List.Flatten(list=list_groupbykey_16.groups, lacing=Longest)

# group: Identifying Mirrored Signatures: Convert to String
element_elementtype_3 = Element.ElementType(element=list_flatten_final_sorted_4)  # "Element.ElementType (InstanceTypesList)"
string_23 = StringInput("Type Name")
element_getparametervaluebyname_3 = Element.GetParameterValueByName(element=element_elementtype_3, parameterName=string_23)  # "Element.GetParameterValueByName (NameList)"
flatten_18 = List.Flatten(list=element_getparametervaluebyname_3)
string_from_object_5 = FromObject(obj=list_flatten_final_sorted_x_list_4)
flatten_19 = List.Flatten(list=string_from_object_5)
string_from_object_6 = FromObject(obj=list_flatten_final_sorted_z_list_4)
flatten_20 = List.Flatten(list=string_from_object_6)
list_create_6 = List.Create(item0=flatten_18, item1=flatten_19, item2=flatten_20)

# group: Identifying Mirrored Signatures: Restructuring flattened Lists
string_24 = StringInput("&&")
string_25 = StringInput(",")
transpose_4 = List.Transpose(lists=list_create_6)
join_9 = String.Join(separator=string_25, string0=transpose_4)
list_count_clustercounts_5 = List.Count(list=element_getparametervaluebyname_3@L2)
chop_6 = List.Chop(list=join_9@L2, lengths=list_count_clustercounts_5)
list_count_clustercounts_6 = List.Count(list=element_getparametervaluebyname_3@L3)
chop_7 = List.Chop(list=chop_6@L3, lengths=list_count_clustercounts_6)
code_block_22 = CodeBlock { 1; }
list_flatten_3 = List.Flatten(list=chop_7, amt=code_block_22)  # "List.Flatten (SameStructureAsInstances)"
join_10 = String.Join(separator=string_24, string0=list_flatten_3)
flatten_21 = List.Flatten(list=join_10)

# group: Identifying Signatures: Convert to String
element_elementtype_4 = Element.ElementType(element=list_flatten_final_sorted_3)  # "Element.ElementType (InstanceTypesList)"
string_26 = StringInput("Type Name")
element_getparametervaluebyname_4 = Element.GetParameterValueByName(element=element_elementtype_4, parameterName=string_26)  # "Element.GetParameterValueByName (NameList)"
flatten_22 = List.Flatten(list=element_getparametervaluebyname_4)
string_from_object_7 = FromObject(obj=list_flatten_final_sorted_x_list_3)
flatten_23 = List.Flatten(list=string_from_object_7)
string_from_object_8 = FromObject(obj=list_flatten_final_sorted_z_list_3)
flatten_24 = List.Flatten(list=string_from_object_8)
list_create_7 = List.Create(item0=flatten_22, item1=flatten_23, item2=flatten_24)

# group: Identifying Signatures: Restructuring flattened Lists
string_27 = StringInput("&&")
string_28 = StringInput(",")
transpose_5 = List.Transpose(lists=list_create_7)
join_11 = String.Join(separator=string_28, string0=transpose_5)
list_count_clustercounts_7 = List.Count(list=element_getparametervaluebyname_4@L2)
chop_8 = List.Chop(list=join_11@L2, lengths=list_count_clustercounts_7)
list_count_clustercounts_8 = List.Count(list=element_getparametervaluebyname_4@L3)
chop_9 = List.Chop(list=chop_8@L3, lengths=list_count_clustercounts_8)
code_block_23 = CodeBlock { 1; }
list_flatten_4 = List.Flatten(list=chop_9, amt=code_block_23)  # "List.Flatten (SameStructureAsInstances)"
join_12 = String.Join(separator=string_27, string0=list_flatten_4)
flatten_25 = List.Flatten(list=join_12)

# group: Combine Original and Mirrored Signatures
list_create_8 = List.Create(item0=flatten_21, item1=flatten_25)
transpose_6 = List.Transpose(lists=list_create_8)
sort_2 = List.Sort(list=transpose_6@L2)
firstItem_2 = List.FirstItem(list=sort_2@L2)

# group: Counting Groups of C2
uniqueItems_2 = List.UniqueItems(list=firstItem_2)
count_14 = List.Count(list=uniqueItems_2)
watch_8 = Watch(count_14)

# group: Assign Dec_Lvl_2 value
string_29 = StringInput("Decomposition_Lvl_2")
list_indexof_idofeachgroup_2 = List.IndexOf(list=uniqueItems_2, element=firstItem_2)
count_15 = List.Count(list=list_flatten_final_sorted_3@L2)
ofRepeatedItem_4 = List.OfRepeatedItem(item=list_indexof_idofeachgroup_2@L1, amount=count_15@L1)
setParameterByName_4 = Element.SetParameterByName(element=list_flatten_final_sorted_3, parameterName=string_29, value=ofRepeatedItem_4)

passthrough = Custom[Passthrough](passThrough=flatten_17, waitFor=setParameterByName_4)  # package Clockwork for Dynamo 2.x; Forces a sequential order of execution. The node wired into the output of the Passthrough node will be executed *after* the node wired into the waitFor input (e.g. important for some Revit operations). The value of the passThrough input will be passed on to the node wired into the output port of the Passthrough node.

# group: Get generic models Xmin and Xmax and ZCentroids
boundingBox_6 = Element.BoundingBox(element=passthrough)
minPoint_6 = BoundingBox.MinPoint(boundingBox=boundingBox_6)
point_x_xmin_6 = Point.X(point=minPoint_6)
maxPoint_6 = BoundingBox.MaxPoint(boundingBox=boundingBox_6)
point_x_xmax_6 = Point.X(point=maxPoint_6)
code_block_xcenter = CodeBlock(Xmin=point_x_xmin_6, Xmax=point_x_xmax_6) { (Xmin+Xmax)/2; }
point_y_ymin_2 = Point.Y(point=minPoint_6)
point_y_ymax_2 = Point.Y(point=maxPoint_6)
code_block_ycenter = CodeBlock(Ymin=point_y_ymin_2, Ymax=point_y_ymax_2) { (Ymin+Ymax)/2; }
point_z_zmin_6 = Point.Z(point=minPoint_6)
point_z_zmax_6 = Point.Z(point=maxPoint_6)
code_block_zcenter = CodeBlock(Zmin=point_z_zmin_6, Zmax=point_z_zmax_6) { (Zmin+Zmax)/2; }
byCoordinates = Point.ByCoordinates(x=code_block_xcenter, y=code_block_ycenter, z=code_block_zcenter)

# group: Read Elements Lvl1 and Lvl2
string_30 = StringInput(",")
string_31 = StringInput("Decomposition_Lvl_1")
getParameterValueByName_6 = Element.GetParameterValueByName(element=passthrough, parameterName=string_31)
string_32 = StringInput("Decomposition_Lvl_2")
getParameterValueByName_7 = Element.GetParameterValueByName(element=passthrough, parameterName=string_32)
list_create_9 = List.Create(item0=getParameterValueByName_6, item1=getParameterValueByName_7)
transpose_7 = List.Transpose(lists=list_create_9)
string_from_object_9 = FromObject(obj=transpose_7)
join_13 = String.Join(separator=string_30, string0=string_from_object_9)
flatten_26 = List.Flatten(list=join_13)

# group: Annotate Elements
views_7 = Views("Complexity Facade")
code_block_24 = CodeBlock { "Center"; }
element_types = ElementTypes("TextNoteType")
all_elements_of_type = ElementsOfType(element_type=element_types)
code_block_25 = CodeBlock { 1; }
getItemAtIndex_2 = List.GetItemAtIndex(list=all_elements_of_type, index=code_block_25)
byLocation = TextNote.ByLocation(view=views_7, location=byCoordinates, text=flatten_26, alignment=code_block_24, type=getItemAtIndex_2)

views_8 = Views("QAFs Representation")
string_33 = StringInput("COMPLEXITY")

# group: Check for existence of horizontal elements
categories_14 = Categories("OST_GenericModel")
views_9 = Views("QAFs Representation")
all_elements_of_category_in_view_6 = ElementsOfCategoryInView(Category=categories_14, View=views_9)

isEmpty_5 = List.IsEmpty(list=all_elements_of_category_in_view_6)
code_block_26 = CodeBlock { 0; }
if_ = If(test=isEmpty_5, true=code_block_26, false=watch_8)

# group: Select Doors, Windows, Stairs, Ramps, and Model Groups
categories_15 = Categories("OST_Doors")
categories_16 = Categories("OST_Windows")
categories_17 = Categories("OST_Stairs")
categories_18 = Categories("OST_Ramps")
categories_19 = Categories("OST_IOSModelGroups")
list_create_10 = List.Create(item0=categories_15, item1=categories_16, item2=categories_17, item3=categories_18, item4=categories_19)
views_10 = Views("QAFs Representation")
all_elements_of_category_in_view_7 = ElementsOfCategoryInView(Category=list_create_10, View=views_10)

# group: Group by Type and Level
string_34 = StringInput("Family and Type")
getParameterValueByName_8 = Element.GetParameterValueByName(element=all_elements_of_category_in_view_7, parameterName=string_34)

# group: Select Generic Models
categories_20 = Categories("OST_GenericModel")
views_11 = Views("QAFs Representation")
all_elements_of_category_in_view_8 = ElementsOfCategoryInView(Category=categories_20, View=views_11)

# group: Group Generic Models by TypeOfComponent
elementType_5 = Element.ElementType(element=all_elements_of_category_in_view_8)
string_35 = StringInput("TypeOfComponent")
getParameterValueByName_9 = Element.GetParameterValueByName(element=elementType_5, parameterName=string_35)
groupByKey = List.GroupByKey(list=elementType_5, keys=getParameterValueByName_9)

# group: Group Generic Models by Volume
geometry = Element.Geometry(element=groupByKey.groups)
volume = Solid.Volume(solid=geometry)
flatten_27 = List.Flatten(list=volume@L3)
code_block_27 = CodeBlock { 2; }
round = Math.Round(number=flatten_27, digits=code_block_27)
groupByKey_2 = List.GroupByKey(list=groupByKey.groups@L2, keys=round@L2)
code_block_28 = CodeBlock { 1; }
flatten_28 = List.Flatten(list=groupByKey_2.groups, amt=code_block_28)

# group: Counting to calculate C3
uniqueItems_3 = List.UniqueItems(list=getParameterValueByName_8@L2)
count_16 = List.Count(list=uniqueItems_3@L2)
isNull = Object.IsNull(obj=flatten_28@L2)
allTrue = List.AllTrue(list=isNull)
boolean_2 = BoolSelector(true)
eq_6 = allTrue == boolean_2
code_block_29 = CodeBlock { 0; }
count_17 = List.Count(list=flatten_28)
if_2 = If(test=eq_6, true=code_block_29, false=count_17)
join_14 = List.Join(list0=count_16, list1=if_2)
flatten_29 = List.Flatten(list=join_14)
math_sum_c3 = Math.Sum(values=flatten_29)

code_block_30 = CodeBlock(C1=watch_2, C2=if_, C3=math_sum_c3) { C1+C2+C3; }
complexity = CodeBlock(COMP=code_block_30) { COMP/68*100; }
setParameterByName_5 = Element.SetParameterByName(element=views_8, parameterName=string_33, value=complexity)

# group: Debug Depth Groups
count_18 = List.Count(list=list_groupbykey_y_2.groups@L3)
total_count_of_width_groups_2 = Watch(count_18)  # "Total Count Of Width Groups Without Removing Redundant Groups"

watch_gaps = Watch(depth_gaps)
watch_9 = Watch(list_groupbykey_x_2.groups)
watch_10 = Watch(list_groupbykey.groups)
watch_11 = Watch(list_groupbykey_2.groups)
watch_12 = Watch(list_groupbykey_2.groups)
watch_13 = Watch(sortByKey_5.sorted_list)
watch_14 = Watch(list_sortbykey_zlist_sorted_by.sorted_list)
watch_15 = Watch(list_sortbykey_instances_sorted.sorted_list)
watch_16 = Watch(list_sortbykey_xlist_sorted_by.sorted_list)

# group: Debug Mirrored Signatures
watch_17 = Watch(flatten_10)
