# Dynamo custom node CumulativeGroupKeys.dyf (Dynamo 2.5.0.7460)
# category: Clockwork

add = _ + _  # unwired: x, y
number = DoubleInput(0)
increments = Input(increments: var[]..[])
scan = ScanList(reductor=add, seed=number, list1=increments)  # "List.Scan"
scannedKeys = Output(scan)
