# Dynamo graph Diversity Representation Script.dyn "Diversity" (Dynamo 2.5.0.7460)

views = Views("QAFs Representation")
string = StringInput("DIVERSITY")

# group: Select families in view
categories = Categories("OST_Windows")
categories_2 = Categories("OST_Doors")
categories_3 = Categories("OST_Stairs")
categories_4 = Categories("OST_Ramps")
list_create = List.Create(item0=categories, item1=categories_2, item2=categories_3, item3=categories_4)
views_2 = Views("QAFs Representation")
all_elements_of_category_in_view = ElementsOfCategoryInView(Category=list_create, View=views_2)
elementType = Element.ElementType(element=all_elements_of_category_in_view)
string_2 = StringInput("Family and Type")
getParameterValueByName = Element.GetParameterValueByName(element=all_elements_of_category_in_view, parameterName=string_2)
groupByKey = List.GroupByKey(list=elementType@L2, keys=getParameterValueByName@L2)
flatten = List.Flatten(list=groupByKey.groups@L2)

# group: Select "Model Groups" in view
categories_5 = Categories("OST_IOSModelGroups")
views_3 = Views("QAFs Representation")
all_elements_of_category_in_view_2 = ElementsOfCategoryInView(Category=categories_5, View=views_3)

# group: Group "Model Groups" by "Type Name" value
elementType_2 = Element.ElementType(element=all_elements_of_category_in_view_2)
string_3 = StringInput("Type Name")
getParameterValueByName_2 = Element.GetParameterValueByName(element=elementType_2, parameterName=string_3)
groupByKey_2 = List.GroupByKey(list=elementType_2, keys=getParameterValueByName_2)

# group: Select "Generic Models" in view
categories_6 = Categories("OST_GenericModel")
views_4 = Views("QAFs Representation")
all_elements_of_category_in_view_3 = ElementsOfCategoryInView(Category=categories_6, View=views_4)

# group: Group "Generic Models" by "TypeOfComponent" value
elementType_3 = Element.ElementType(element=all_elements_of_category_in_view_3)
string_4 = StringInput("TypeOfComponent")
getParameterValueByName_3 = Element.GetParameterValueByName(element=elementType_3, parameterName=string_4)
groupByKey_3 = List.GroupByKey(list=elementType_3, keys=getParameterValueByName_3)

# group: Group "Generic Models" by volume
geometry = Element.Geometry(element=groupByKey_3.groups)
volume = Solid.Volume(solid=geometry)
code_block = CodeBlock { 2; }
round = Math.Round(number=volume, digits=code_block)
area = Solid.Area(solid=geometry)
round_2 = Math.Round(number=area, digits=code_block)
div = round / round_2
flatten_2 = List.Flatten(list=div@L3)
groupByKey_4 = List.GroupByKey(list=groupByKey_3.groups@L2, keys=flatten_2@L2)
flatten_3 = List.Flatten(list=groupByKey_4.groups@L2)

join = List.Join(list0=flatten, list1=groupByKey_2.groups, list2=flatten_3)

# group: Exclude instances without TypeOfComponent value
string_5 = StringInput("TypeOfComponent")
getParameterValueByName_4 = Element.GetParameterValueByName(element=join, parameterName=string_5)
string_6 = StringInput("")
ne = _ != string_6  # unwired: x
map = List.Map(f_x=ne)  # unwired: list
map_2 = List.Map(list=getParameterValueByName_4, f_x=map)
filterByBoolMask = List.FilterByBoolMask(list=join, mask=map_2)

# group: Instances count for each element type
list_count_instances_count = List.Count(list=filterByBoolMask.in@L2)
code_block_2 = CodeBlock { 0; }
gt = list_count_instances_count > code_block_2
filterByBoolMask_2 = List.FilterByBoolMask(list=list_count_instances_count, mask=gt)

# group: Pi calculation for each element type
math_sum_total = Math.Sum(values=filterByBoolMask_2.in)
div_2 = filterByBoolMask_2.in / math_sum_total

# group: Pi ^ (-Pi)
number = DoubleInput(0)
sub = number - div_2
pow = Math.Pow(number=div_2, power=sub)

# group: PP value
mul = _ * _  # unwired: x, y
number_2 = DoubleInput(1)
reduce = List.Reduce(reductor=mul, seed=number_2, list1=pow)

# group: Diversity percentage
code_block_3 = CodeBlock(x=reduce) { x / 20.07 * 100; }
code_block_4 = CodeBlock { 0; }
round_3 = Math.Round(number=code_block_3, digits=code_block_4)
watch = Watch(round_3)

setParameterByName = Element.SetParameterByName(element=views, parameterName=string, value=watch)
sort = List.Sort(list=filterByBoolMask_2.in)
watch_2 = Watch(filterByBoolMask.out)
