# Dynamo graph Regularity Representation Script.dyn "Regularity 13 (Coefficient) (Separating Masses)" (Dynamo 2.5.0.7460)

views = Views("QAFs Representation")
string = StringInput("REGULARITY")

# group: Select Windows in View
categories = Categories("OST_Windows")
views_2 = Views("QAFs Representation")
all_elements_of_category_in_view = ElementsOfCategoryInView(Category=categories, View=views_2)

# group: Create window pairs
list_create = List.Create()  # unwired: item0, item1
cartesianProduct = List.CartesianProduct(comb=list_create, list1=all_elements_of_category_in_view, list2=all_elements_of_category_in_view)

# group: Filter pairs in the same protrusion mass
code_block = CodeBlock { 1; }
flatten = List.Flatten(list=cartesianProduct, amt=code_block)
code_block_2 = CodeBlock { 0; }
removeItemAtIndex = List.RemoveItemAtIndex(list=cartesianProduct@L2, indices=code_block_2)
getLocation = Element.GetLocation(element=removeItemAtIndex)
Y = Point.Y(point=getLocation)
code_block_3 = CodeBlock { 1; }
removeItemAtIndex_2 = List.RemoveItemAtIndex(list=cartesianProduct@L2, indices=code_block_3)
getLocation_2 = Element.GetLocation(element=removeItemAtIndex_2)
Y_2 = Point.Y(point=getLocation_2)
eq = Y == Y_2
flatten_2 = List.Flatten(list=eq)
filterByBoolMask = List.FilterByBoolMask(list=flatten, mask=flatten_2)

# group: Remove duplicate pairs [A,A]
code_block_4 = CodeBlock { 0; }
removeItemAtIndex_3 = List.RemoveItemAtIndex(list=filterByBoolMask.in@L2, indices=code_block_4)
id = Element.Id(element=removeItemAtIndex_3)
code_block_5 = CodeBlock { 1; }
removeItemAtIndex_4 = List.RemoveItemAtIndex(list=filterByBoolMask.in@L2, indices=code_block_5)
id_2 = Element.Id(element=removeItemAtIndex_4)
eq_2 = id == id_2
not_ = Not(x=eq_2)
flatten_3 = List.Flatten(list=not_)
filterByBoolMask_2 = List.FilterByBoolMask(list=filterByBoolMask.in, mask=flatten_3)
code_block_6 = CodeBlock { 1; }
flatten_4 = List.Flatten(list=filterByBoolMask.in, amt=code_block_6)

# group: Separate each pair instances
code_block_7 = CodeBlock { 0; }
removeItemAtIndex_5 = List.RemoveItemAtIndex(list=filterByBoolMask_2.in@@L2, indices=code_block_7)
code_block_8 = CodeBlock { 1; }
removeItemAtIndex_6 = List.RemoveItemAtIndex(list=filterByBoolMask_2.in@@L2, indices=code_block_8)

# group: Delta Z for each pair
getLocation_3 = Element.GetLocation(element=removeItemAtIndex_5)
Z = Point.Z(point=getLocation_3)
code_block_9 = CodeBlock { 1; }
round = Math.Round(number=Z, digits=code_block_9)
getLocation_4 = Element.GetLocation(element=removeItemAtIndex_6)
Z_2 = Point.Z(point=getLocation_4)
round_2 = Math.Round(number=Z_2, digits=code_block_9)
delta_z = round - round_2
list_flatten_deltaz = List.Flatten(list=delta_z)

# group: Filter (Up) pairs
code_block_10 = CodeBlock { 0; }
delta_z_0_up = list_flatten_deltaz > code_block_10
list_filterbyboolmask_up = List.FilterByBoolMask(list=filterByBoolMask_2.in, mask=delta_z_0_up)
watch = Watch(list_filterbyboolmask_up.in)

# group: Group Up pairs by sublists representing each instance
firstItem = List.FirstItem(list=watch@L2)
id_3 = Element.Id(element=firstItem)
groupByKey = List.GroupByKey(list=watch, keys=id_3)
watch_2 = Watch(groupByKey.groups)

# group: Separate instances of each pair
code_block_11 = CodeBlock { 1; }
removeItemAtIndex_7 = List.RemoveItemAtIndex(list=watch_2@@L2, indices=code_block_11)
code_block_12 = CodeBlock { 0; }
removeItemAtIndex_8 = List.RemoveItemAtIndex(list=watch_2@@L2, indices=code_block_12)

# group: Centroid Calculation
boundingBox = Element.BoundingBox(element=removeItemAtIndex_7)
minPoint = BoundingBox.MinPoint(boundingBox=boundingBox)
X = Point.X(point=minPoint)
maxPoint = BoundingBox.MaxPoint(boundingBox=boundingBox)
X_2 = Point.X(point=maxPoint)
code_block_13 = CodeBlock(Xmin=X, Xmax=X_2) { (Xmin+Xmax)/2; }
Y_3 = Point.Y(point=minPoint)
Y_4 = Point.Y(point=maxPoint)
code_block_14 = CodeBlock(Ymin=Y_3, Ymax=Y_4) { (Ymin+Ymax)/2; }
Z_3 = Point.Z(point=minPoint)
Z_4 = Point.Z(point=maxPoint)
code_block_15 = CodeBlock(Zmin=Z_3, Zmax=Z_4) { (Zmin+Zmax)/2; }
byCoordinates = Point.ByCoordinates(x=code_block_13, y=code_block_14, z=code_block_15)

# group: Centroid Calculation
boundingBox_2 = Element.BoundingBox(element=removeItemAtIndex_8)
minPoint_2 = BoundingBox.MinPoint(boundingBox=boundingBox_2)
X_3 = Point.X(point=minPoint_2)
maxPoint_2 = BoundingBox.MaxPoint(boundingBox=boundingBox_2)
X_4 = Point.X(point=maxPoint_2)
code_block_16 = CodeBlock(Xmin=X_3, Xmax=X_4) { (Xmin+Xmax)/2; }
Y_5 = Point.Y(point=minPoint_2)
Y_6 = Point.Y(point=maxPoint_2)
code_block_17 = CodeBlock(Ymin=Y_5, Ymax=Y_6) { (Ymin+Ymax)/2; }
Z_5 = Point.Z(point=minPoint_2)
Z_6 = Point.Z(point=maxPoint_2)
code_block_18 = CodeBlock(Zmin=Z_5, Zmax=Z_6) { (Zmin+Zmax)/2; }
byCoordinates_2 = Point.ByCoordinates(x=code_block_16, y=code_block_17, z=code_block_18)

byStartPointEndPoint = Line.ByStartPointEndPoint(startPoint=byCoordinates, endPoint=byCoordinates_2)
watch_uplines = Watch(byStartPointEndPoint)
flatten_5 = List.Flatten(list=watch_uplines@@L3)
length = Curve.Length(curve=flatten_5)
code_block_19 = CodeBlock { 2; }
round_3 = Math.Round(number=length, digits=code_block_19)
minimumItem = List.MinimumItem(list=round_3@@L2)
indexOf = List.IndexOf(list=round_3@L2, element=minimumItem, lacing=Longest)
getItemAtIndex = List.GetItemAtIndex(list=flatten_5@@L2, index=indexOf@L1)

# group: Filter (Down) pairs
code_block_20 = CodeBlock { 0; }
delta_z_0_down = list_flatten_deltaz < code_block_20
list_filterbyboolmask_up_2 = List.FilterByBoolMask(list=filterByBoolMask_2.in, mask=delta_z_0_down)
watch_3 = Watch(list_filterbyboolmask_up_2.in)

# group: Group Down pairs by sublists representing each instance
firstItem_2 = List.FirstItem(list=watch_3@L2)
id_4 = Element.Id(element=firstItem_2)
groupByKey_2 = List.GroupByKey(list=watch_3, keys=id_4)
watch_4 = Watch(groupByKey_2.groups)

# group: Separate instances of each pair
code_block_21 = CodeBlock { 1; }
removeItemAtIndex_9 = List.RemoveItemAtIndex(list=watch_4@@L2, indices=code_block_21)
code_block_22 = CodeBlock { 0; }
removeItemAtIndex_10 = List.RemoveItemAtIndex(list=watch_4@@L2, indices=code_block_22)

# group: Centroid Calculation
boundingBox_3 = Element.BoundingBox(element=removeItemAtIndex_9)
minPoint_3 = BoundingBox.MinPoint(boundingBox=boundingBox_3)
X_5 = Point.X(point=minPoint_3)
maxPoint_3 = BoundingBox.MaxPoint(boundingBox=boundingBox_3)
X_6 = Point.X(point=maxPoint_3)
code_block_23 = CodeBlock(Xmin=X_5, Xmax=X_6) { (Xmin+Xmax)/2; }
Y_7 = Point.Y(point=minPoint_3)
Y_8 = Point.Y(point=maxPoint_3)
code_block_24 = CodeBlock(Ymin=Y_7, Ymax=Y_8) { (Ymin+Ymax)/2; }
Z_7 = Point.Z(point=minPoint_3)
Z_8 = Point.Z(point=maxPoint_3)
code_block_25 = CodeBlock(Zmin=Z_7, Zmax=Z_8) { (Zmin+Zmax)/2; }
byCoordinates_3 = Point.ByCoordinates(x=code_block_23, y=code_block_24, z=code_block_25)

# group: Centroid Calculation
boundingBox_4 = Element.BoundingBox(element=removeItemAtIndex_10)
minPoint_4 = BoundingBox.MinPoint(boundingBox=boundingBox_4)
X_7 = Point.X(point=minPoint_4)
maxPoint_4 = BoundingBox.MaxPoint(boundingBox=boundingBox_4)
X_8 = Point.X(point=maxPoint_4)
code_block_26 = CodeBlock(Xmin=X_7, Xmax=X_8) { (Xmin+Xmax)/2; }
Y_9 = Point.Y(point=minPoint_4)
Y_10 = Point.Y(point=maxPoint_4)
code_block_27 = CodeBlock(Ymin=Y_9, Ymax=Y_10) { (Ymin+Ymax)/2; }
Z_9 = Point.Z(point=minPoint_4)
Z_10 = Point.Z(point=maxPoint_4)
code_block_28 = CodeBlock(Zmin=Z_9, Zmax=Z_10) { (Zmin+Zmax)/2; }
byCoordinates_4 = Point.ByCoordinates(x=code_block_26, y=code_block_27, z=code_block_28)

byStartPointEndPoint_2 = Line.ByStartPointEndPoint(startPoint=byCoordinates_3, endPoint=byCoordinates_4)
curve_reverse_downlines = Curve.Reverse(curve=byStartPointEndPoint_2)
flatten_6 = List.Flatten(list=curve_reverse_downlines@@L3)
length_2 = Curve.Length(curve=flatten_6)
round_4 = Math.Round(number=length_2, digits=code_block_19)
minimumItem_2 = List.MinimumItem(list=round_4)
indexOf_2 = List.IndexOf(list=round_4@L2, element=minimumItem_2, lacing=Longest)
getItemAtIndex_2 = List.GetItemAtIndex(list=flatten_6@@L2, index=indexOf_2@L1)
list_create_2 = List.Create(item0=getItemAtIndex, item1=getItemAtIndex_2)
flatten_7 = List.Flatten(list=list_create_2)
string_2 = StringInput(" & ")
string_3 = StringInput(",")
startPoint = Curve.StartPoint(curve=flatten_7)
X_9 = Point.X(point=startPoint)
code_block_29 = CodeBlock { 2; }
round_5 = Math.Round(number=X_9, digits=code_block_29)
Z_11 = Point.Z(point=startPoint)
round_6 = Math.Round(number=Z_11, digits=code_block_29)
list_create_3 = List.Create(item0=round_5, item1=round_6)
list_transpose_start_x_z = List.Transpose(lists=list_create_3)
string_from_object = FromObject(obj=list_transpose_start_x_z)
join = String.Join(separator=string_3, string0=string_from_object)
string_4 = StringInput(",")
endPoint = Curve.EndPoint(curve=flatten_7)
X_10 = Point.X(point=endPoint)
round_7 = Math.Round(number=X_10, digits=code_block_29)
Z_12 = Point.Z(point=endPoint)
round_8 = Math.Round(number=Z_12, digits=code_block_29)
list_create_4 = List.Create(item0=round_7, item1=round_8)
list_transpose_end_x_z = List.Transpose(lists=list_create_4)
string_from_object_2 = FromObject(obj=list_transpose_end_x_z)
join_2 = String.Join(separator=string_4, string0=string_from_object_2)
join_3 = List.Join(list0=join, list1=join_2)
transpose = List.Transpose(lists=join_3)
join_4 = String.Join(separator=string_2, string0=transpose)
uniqueItems = List.UniqueItems(list=join_4@L2)
indexOf_3 = List.IndexOf(list=join_4@L2, element=uniqueItems@L2)
getItemAtIndex_3 = List.GetItemAtIndex(list=flatten_7, index=indexOf_3)
length_3 = Curve.Length(curve=getItemAtIndex_3)
flatten_8 = List.Flatten(list=length_3)

# group: Group by Y (recess and protrusion)
getLocation_5 = Element.GetLocation(element=all_elements_of_category_in_view)
Y_11 = Point.Y(point=getLocation_5)
code_block_30 = CodeBlock { 1; }
round_9 = Math.Round(number=Y_11, digits=code_block_30)
list_groupbykey = List.GroupByKey(list=all_elements_of_category_in_view@L2, keys=round_9@L2)  # "List.GroupByKey (LevelThenYGroupedElements)"
watch_5 = Watch(list_groupbykey.groups)

# group: Group by level
string_5 = StringInput("Level")
getParameterValueByName = Element.GetParameterValueByName(element=watch_5, parameterName=string_5)
list_groupbykey_2 = List.GroupByKey(list=watch_5@L2, keys=getParameterValueByName@L2)  # "List.GroupByKey (LevelGroupedElements)"

# group: Sort each level by X
getLocation_6 = Element.GetLocation(element=list_groupbykey_2.groups)
X_11 = Point.X(point=getLocation_6)
list_sortbykey = List.SortByKey(list=list_groupbykey_2.groups@@L2, keys=X_11@L2)  # "List.SortByKey (SortedLevelThenYGroupedElements)"

# group: Center of item (i)
boundingBox_5 = Element.BoundingBox(element=list_sortbykey.sorted_list)
minPoint_5 = BoundingBox.MinPoint(boundingBox=boundingBox_5)
X_12 = Point.X(point=minPoint_5)
maxPoint_5 = BoundingBox.MaxPoint(boundingBox=boundingBox_5)
X_13 = Point.X(point=maxPoint_5)
code_block_31 = CodeBlock(Xmin=X_12, Xmax=X_13) { (Xmin+Xmax)/2; }
Y_12 = Point.Y(point=minPoint_5)
Y_13 = Point.Y(point=maxPoint_5)
code_block_32 = CodeBlock(Ymin=Y_12, Ymax=Y_13) { (Ymin+Ymax)/2; }
Z_13 = Point.Z(point=minPoint_5)
Z_14 = Point.Z(point=maxPoint_5)
code_block_33 = CodeBlock(Zmin=Z_13, Zmax=Z_14) { (Zmin+Zmax)/2; }
byCoordinates_5 = Point.ByCoordinates(x=code_block_31, y=code_block_32, z=code_block_33)

# group: Remove 1st item
code_block_34 = CodeBlock { 0; }
removeItemAtIndex_11 = List.RemoveItemAtIndex(list=list_sortbykey.sorted_list@@L2, indices=code_block_34)

# group: Center of item (i+1)
boundingBox_6 = Element.BoundingBox(element=removeItemAtIndex_11)
minPoint_6 = BoundingBox.MinPoint(boundingBox=boundingBox_6)
X_14 = Point.X(point=minPoint_6)
maxPoint_6 = BoundingBox.MaxPoint(boundingBox=boundingBox_6)
X_15 = Point.X(point=maxPoint_6)
code_block_35 = CodeBlock(Xmin=X_14, Xmax=X_15) { (Xmin+Xmax)/2; }
Y_14 = Point.Y(point=minPoint_6)
Y_15 = Point.Y(point=maxPoint_6)
code_block_36 = CodeBlock(Ymin=Y_14, Ymax=Y_15) { (Ymin+Ymax)/2; }
Z_15 = Point.Z(point=minPoint_6)
Z_16 = Point.Z(point=maxPoint_6)
code_block_37 = CodeBlock(Zmin=Z_15, Zmax=Z_16) { (Zmin+Zmax)/2; }
byCoordinates_6 = Point.ByCoordinates(x=code_block_35, y=code_block_36, z=code_block_37)

# group: Distance Rounding Threshold
code_block_rounding_threshold = CodeBlock { 2; }

# group: Horizontal distances
byStartPointEndPoint_3 = Line.ByStartPointEndPoint(startPoint=byCoordinates_5@L2, endPoint=byCoordinates_6@@L2, lacing=Shortest)
length_4 = Curve.Length(curve=byStartPointEndPoint_3)
round_10 = Math.Round(number=length_4, digits=code_block_rounding_threshold)
flatten_9 = List.Flatten(list=round_10)

join_5 = List.Join(list0=flatten_8, list1=flatten_9)
round_11 = Math.Round(number=join_5, digits=code_block_rounding_threshold)

# group: Calculate H
groupByKey_3 = List.GroupByKey(list=round_11, keys=round_11)
list_count_distance_classes = List.Count(list=groupByKey_3.groups@L2)
sum = Math.Sum(values=list_count_distance_classes)
pi_list = list_count_distance_classes / sum
code_block_38 = CodeBlock { 2; }
math_log_log2pi = Math.Log(number=pi_list, logBase=code_block_38)
mul = pi_list * math_log_log2pi
sum_2 = Math.Sum(values=mul)
abs = Math.Abs(number=sum_2)
div = abs / sum
code_block_r = CodeBlock(x=div) { (1-x)*100; }
watch_6 = Watch(groupByKey_3.groups)

setParameterByName = Element.SetParameterByName(element=views, parameterName=string, value=code_block_r)
uniqueItems_2 = List.UniqueItems()  # unwired: list
