# Dynamo graph Regularity Type Representation Script.dyn "Regularity 5" (Dynamo 2.5.0.7460)

# group: Select Windows in view
categories = Categories("OST_Windows")
views = Views("QAFs Representation")
all_elements_of_category_in_view = ElementsOfCategoryInView(Category=categories, View=views)

# group: Group by Level
string = StringInput("Level")
getParameterValueByName = Element.GetParameterValueByName(element=all_elements_of_category_in_view, parameterName=string)
groupByKey = List.GroupByKey(list=all_elements_of_category_in_view, keys=getParameterValueByName)

# group: Read "width" values for each floor
elementType = Element.ElementType(element=groupByKey.groups)
string_2 = StringInput("Width")
getParameterValueByName_2 = Element.GetParameterValueByName(element=elementType, parameterName=string_2)

# group: Calculate St.Dev. for each floor
average = Math.Average(numbers=getParameterValueByName_2)
code_block = CodeBlock(x=getParameterValueByName_2, mean=average) { x - mean; }
code_block_2 = CodeBlock(diff=code_block) { diff * diff; }
sum = Math.Sum(values=code_block_2)
count = List.Count(list=getParameterValueByName_2)
div = sum / count
sqrt = Math.Sqrt(number=div)

# group: Check for (W2) in each level
code_block_3 = CodeBlock(stdev=sqrt) { threshold = 0.05; stdev <= threshold; }
allTrue = List.AllTrue(list=code_block_3.out1)
string_3 = StringInput("W2 is TRUE")
string_4 = StringInput("W2 is FALSE")
if_ = If(test=allTrue, true=string_3, false=string_4)
watch = Watch(if_)

# group: Read "height" values
elementType_2 = Element.ElementType(element=all_elements_of_category_in_view)
string_5 = StringInput("Height")
getParameterValueByName_3 = Element.GetParameterValueByName(element=elementType_2, parameterName=string_5)

# group: Calculate St.Dev.
average_2 = Math.Average(numbers=getParameterValueByName_3)
code_block_4 = CodeBlock(x=getParameterValueByName_3, mean=average_2) { x - mean; }
code_block_5 = CodeBlock(diff=code_block_4) { diff * diff; }
sum_2 = Math.Sum(values=code_block_5)
count_2 = List.Count(list=getParameterValueByName_3)
div_2 = sum_2 / count_2
sqrt_2 = Math.Sqrt(number=div_2)

# group: Check for (H)
code_block_6 = CodeBlock(stdev=sqrt_2) { threshold = 0.05; stdev <= threshold; }
string_6 = StringInput("H is TRUE")
string_7 = StringInput("H is FALSE")
if_2 = If(test=code_block_6.out1, true=string_6, false=string_7)
watch_2 = Watch(if_2)

# group: Read "Head Height"
string_8 = StringInput("Head Height")
getParameterValueByName_4 = Element.GetParameterValueByName(element=groupByKey.groups, parameterName=string_8)

# group: Calculate St.Dev.
average_3 = Math.Average(numbers=getParameterValueByName_4)
code_block_7 = CodeBlock(x=getParameterValueByName_4, mean=average_3) { x - mean; }
code_block_8 = CodeBlock(diff=code_block_7) { diff * diff; }
sum_3 = Math.Sum(values=code_block_8)
count_3 = List.Count(list=getParameterValueByName_4)
div_3 = sum_3 / count_3
sqrt_3 = Math.Sqrt(number=div_3)

# group: Check for (TE)
code_block_9 = CodeBlock(stdev=sqrt_3) { threshold = 0.05; stdev <= threshold; }
string_9 = StringInput("TE is TRUE")
string_10 = StringInput("TE is FALSE")
if_3 = If(test=code_block_9.out1, true=string_9, false=string_10)
watch_3 = Watch(if_3)
allTrue_2 = List.AllTrue(list=code_block_9.out1)
if_4 = If(test=allTrue_2, true=string_9, false=string_10)
watch_4 = Watch(if_4)

# group: Read "Sill Height"
string_11 = StringInput("Sill Height")
getParameterValueByName_5 = Element.GetParameterValueByName(element=groupByKey.groups, parameterName=string_11)

# group: Calculate St.Dev.
average_4 = Math.Average(numbers=getParameterValueByName_5)
code_block_10 = CodeBlock(x=getParameterValueByName_5, mean=average_4) { x - mean; }
code_block_11 = CodeBlock(diff=code_block_10) { diff * diff; }
sum_4 = Math.Sum(values=code_block_11)
count_4 = List.Count(list=getParameterValueByName_5)
div_4 = sum_4 / count_4
sqrt_4 = Math.Sqrt(number=div_4)

# group: Check for (BE)
code_block_12 = CodeBlock(stdev=sqrt_4) { threshold = 0.05; stdev <= threshold; }
string_12 = StringInput("BE is TRUE")
string_13 = StringInput("BE is FALSE")
if_5 = If(test=code_block_12.out1, true=string_12, false=string_13)
watch_5 = Watch(if_5)
allTrue_3 = List.AllTrue(list=code_block_12.out1)
if_6 = If(test=allTrue_3, true=string_12, false=string_13)
watch_6 = Watch(if_6)

# group: Group Columns of windows
getLocation = Element.GetLocation(element=all_elements_of_category_in_view)
X = Point.X(point=getLocation)
round = Math.Round(number=X)
groupByKey_2 = List.GroupByKey(list=all_elements_of_category_in_view, keys=round)

# group: Sort by Z value
getLocation_2 = Element.GetLocation(element=groupByKey_2.groups)
Z = Point.Z(point=getLocation_2)
sortByKey = List.SortByKey(list=groupByKey_2.groups@L2, keys=Z@L2)

# group: Sorted Z values
getLocation_3 = Element.GetLocation(element=sortByKey.sorted_list)
Z_2 = Point.Z(point=getLocation_3)

# group: Calculate vertical distances
restOfItems = List.RestOfItems(list=Z_2@L2)
number = DoubleInput(-1)
dropItems = List.DropItems(list=Z_2@L2, amount=number)
sub = restOfItems - dropItems

# group: Calculate St.Dev. of horizontal distances
average_5 = Math.Average(numbers=sub@L2)
code_block_13 = CodeBlock(x=sub, mean=average_5) { x - mean; }
code_block_14 = CodeBlock(diff=code_block_13) { diff * diff; }
sum_5 = Math.Sum(values=code_block_14)
count_5 = List.Count(list=sub@L2)
div_5 = sum_5 / count_5
sqrt_5 = Math.Sqrt(number=div_5)

# group: Check for (VD)
code_block_15 = CodeBlock(stdev=sqrt_5) { threshold = 0.05; stdev <= threshold; }
string_14 = StringInput("VD is TRUE")
string_15 = StringInput("VD is FALSE")
if_7 = If(test=code_block_15.out1, true=string_14, false=string_15)
watch_7 = Watch(if_7)
allTrue_4 = List.AllTrue(list=code_block_15.out1)
if_8 = If(test=allTrue_4, true=string_14, false=string_15)
watch_8 = Watch(if_8)

# group: Calculate Xcenter, Xright, and Xleft for windows
elementType_3 = Element.ElementType(element=all_elements_of_category_in_view)
string_16 = StringInput("Width")
getParameterValueByName_6 = Element.GetParameterValueByName(element=elementType_3, parameterName=string_16)
number_2 = DoubleInput(2)
div_6 = getParameterValueByName_6 / number_2
getLocation_4 = Element.GetLocation(element=all_elements_of_category_in_view)
XCenter = Point.X(point=getLocation_4)
xright = div_6 + XCenter
xleft = XCenter - div_6

# group: Join all X values
list_create = List.Create(item0=xright, item1=xleft, item2=XCenter)
flatten = List.Flatten(list=list_create)

# group: Subtract every X value from all other values
number_3 = DoubleInput(0)
count_6 = List.Count(list=flatten)
number_4 = DoubleInput(1)
sub_2 = count_6 - number_4
range = Range(start=number_3, end=sub_2, step=number_4)
getItemAtIndex = List.GetItemAtIndex(list=flatten, index=range)
ofRepeatedItem = List.OfRepeatedItem(item=flatten, amount=count_6)
removeItemAtIndex = List.RemoveItemAtIndex(list=ofRepeatedItem, indices=range, lacing=Shortest)
sub_3 = getItemAtIndex - removeItemAtIndex  # lacing=Longest
abs = Math.Abs(number=sub_3)

# group: Check for any similarity (difference < 0.15)
number_5 = DoubleInput(0.15)
le = abs <= number_5
boolean = BoolSelector(true)
contains = List.Contains(list=le, item=boolean, lacing=Longest)

# group: Subdivide flattened list to original sublists (Xright, Xleft, and Xcenter)
count_7 = List.Count(list=xright)
count_8 = List.Count(list=xleft)
count_9 = List.Count(list=XCenter)
list_create_2 = List.Create(item0=count_7, item1=count_8, item2=count_9)
chop = List.Chop(list=contains, lengths=list_create_2)

# group: Group (Xright, Xleft, and Xcenter) for each element in a sublist
transpose = List.Transpose(lists=chop)
boolean_2 = BoolSelector(true)
contains_2 = List.Contains(item=boolean_2)  # unwired: list
map = List.Map(list=transpose, f_x=contains_2)

# group: Check for (CL)
boolean_3 = BoolSelector(false)
contains_3 = List.Contains(list=map, item=boolean_3)
string_17 = StringInput("CL is FALSE")
string_18 = StringInput("CL is TRUE")
if_9 = If(test=contains_3, true=string_17, false=string_18)
watch_9 = Watch(if_9)

# group: Sort by X value
getLocation_5 = Element.GetLocation(element=groupByKey.groups)
X_2 = Point.X(point=getLocation_5)
sort = List.Sort(list=X_2)

# group: Exclude levels with only one window
count_10 = List.Count(list=sort@L2)
number_6 = DoubleInput(2)
ge = count_10 >= number_6
list_filterbyboolmask_xcenter = List.FilterByBoolMask(list=sort, mask=ge)

# group: Calculate Xright and Xleft of windows
elementType_4 = Element.ElementType(element=groupByKey.groups)
string_19 = StringInput("Width")
element_getparametervaluebyname = Element.GetParameterValueByName(element=elementType_4, parameterName=string_19)  # "Element.GetParameterValueByName (WIDTHES)"
list_sortbykey_sorted_widthes = List.SortByKey(list=element_getparametervaluebyname@L2, keys=X_2@L2)  # "List.SortByKey (SORTED WIDTHES ACCORDING TO WINDOW LOCATION)"
list_filterbyboolmask_windows = List.FilterByBoolMask(list=list_sortbykey_sorted_widthes.sorted_list, mask=ge)  # "List.FilterByBoolMask (windows widthes)"
xright_2 = CodeBlock(x=list_filterbyboolmask_xcenter.in, Y=list_filterbyboolmask_windows.in) { x+(0.5*Y); }
xleft_2 = CodeBlock(x=list_filterbyboolmask_xcenter.in, Y=list_filterbyboolmask_windows.in) { x-(0.5*Y); }

code_block_16 = CodeBlock { 2; }
round_2 = Math.Round(number=xright_2, digits=code_block_16)

# group: Calculate horizontal distances
number_7 = DoubleInput(0)
removeItemAtIndex_2 = List.RemoveItemAtIndex(list=xleft_2@L2, indices=number_7)
number_8 = DoubleInput(-1)
dropItems_2 = List.DropItems(list=xright_2, amount=number_8)
sub_4 = removeItemAtIndex_2 - dropItems_2
number_9 = DoubleInput(2)
round_3 = Math.Round(number=sub_4, digits=number_9)

# group: Number of row types
list_uniqueitems_xrights = List.UniqueItems(list=round_2)
list_count_xrights = List.Count(list=list_uniqueitems_xrights)
list_uniqueitems_h_distances = List.UniqueItems(list=round_3)
list_count_h_distances = List.Count(list=list_uniqueitems_h_distances)

# group: Check for (HR and VR)
number_10 = DoubleInput(1)
xrights_count_is_1 = list_count_xrights == number_10
number_11 = DoubleInput(1)
h_distances_is_1 = list_count_h_distances == number_11
and_ = xrights_count_is_1 && h_distances_is_1
string_20 = StringInput("VR  is True and HR is True")
number_12 = DoubleInput(3)
xrights_count_is_less_than_3 = list_count_xrights < number_12
number_13 = DoubleInput(2)
h_distances_count_is_2 = list_count_h_distances == number_13
or_ = h_distances_count_is_2 || h_distances_is_1
and_2 = xrights_count_is_less_than_3 && or_
string_21 = StringInput("VR is True and HR is Every Second")
string_22 = StringInput("VR is FALSE and HR is FALSE")
if_10 = If(test=and_2, true=string_21, false=string_22)
if_11 = If(test=and_, true=string_20, false=if_10)
watch_10 = Watch(if_11)

# group: Read "width" values
elementType_5 = Element.ElementType(element=all_elements_of_category_in_view)
string_23 = StringInput("Width")
getParameterValueByName_7 = Element.GetParameterValueByName(element=elementType_5, parameterName=string_23)

# group: Calculate St.Dev.
average_6 = Math.Average(numbers=getParameterValueByName_7)
code_block_17 = CodeBlock(x=getParameterValueByName_7, mean=average_6) { x - mean; }
code_block_18 = CodeBlock(diff=code_block_17) { diff * diff; }
sum_6 = Math.Sum(values=code_block_18)
count_11 = List.Count(list=getParameterValueByName_7)
div_7 = sum_6 / count_11
sqrt_6 = Math.Sqrt(number=div_7)

# group: Check for (W)
code_block_19 = CodeBlock(stdev=sqrt_6) { threshold = 0.05; stdev <= threshold; }
string_24 = StringInput("W is TRUE")
string_25 = StringInput("W is FALSE")
if_12 = If(test=code_block_19.out1, true=string_24, false=string_25)
watch_11 = Watch(if_12)

# group: Check for the case: only one column of windows
allFalse = List.AllFalse(list=ge)
number_14 = DoubleInput(1)
list_create_3 = List.Create(item0=number_14, item1=number_14, item2=number_14, item3=number_14, item4=number_14, item5=number_14, item6=number_14, item7=number_14, item8=number_14, item9=number_14, item10=number_14, item11=number_14, item12=number_14, item13=number_14, item14=number_14, item15=number_14)
if_13 = If(test=allFalse, true=list_create_3, false=round_3)
flatten_2 = List.Flatten(list=if_13)

# group: Calculate St.Dev. of horizontal distances
average_7 = Math.Average(numbers=flatten_2@L2)
sub_5 = flatten_2@L3 - average_7
code_block_20 = CodeBlock(diff=sub_5) { diff * diff; }
sum_7 = Math.Sum(values=code_block_20)
count_12 = List.Count(list=flatten_2@L2)
div_8 = sum_7 / count_12
sqrt_7 = Math.Sqrt(number=div_8@L1)

# group: Check for horizontal distances (HD) overall
code_block_21 = CodeBlock(stdev=sqrt_7) { threshold = 0.05; stdev <= threshold; }
string_26 = StringInput("HD is TRUE")
string_27 = StringInput("HD is FALSE")
if_14 = If(test=code_block_21.out1, true=string_26, false=string_27)
watch_12 = Watch(if_14)

# group: Calculate the difference in horizontal distances for the case of only two horizontal distances
count_13 = List.Count(list=round_3@L2)
number_15 = DoubleInput(2)
eq = count_13 == number_15
number_16 = DoubleInput(0)
getItemAtIndex_2 = List.GetItemAtIndex(list=round_3, index=number_16)
number_17 = DoubleInput(1)
getItemAtIndex_3 = List.GetItemAtIndex(list=round_3, index=number_17)
sub_6 = getItemAtIndex_2 - getItemAtIndex_3
abs_2 = Math.Abs(number=sub_6)
flatten_3 = List.Flatten(list=round_3)
minimumItem = List.MinimumItem(list=flatten_3)
code_block_22 = CodeBlock(dif=abs_2, min=minimumItem) { dif < (0.05*min); }
allTrue_5 = List.AllTrue(list=code_block_22)

# group: Calculate St.Dev. of horizontal distances in each level
average_8 = Math.Average(numbers=if_13@L2)
code_block_23 = CodeBlock(x=if_13, mean=average_8) { x - mean; }
code_block_24 = CodeBlock(diff=code_block_23) { diff * diff; }
sum_8 = Math.Sum(values=code_block_24)
count_14 = List.Count(list=if_13@L2)
div_9 = sum_8 / count_14
sqrt_8 = Math.Sqrt(number=div_9)

# group: Calculate the difference in horizontal distances
code_block_25 = CodeBlock(stdev=sqrt_8) { threshold = 0.05; stdev <= threshold; }
allTrue_6 = List.AllTrue(list=code_block_25.out1)

# group: Check for horizontal distances in each row (HD2)
if_15 = If(test=eq, true=allTrue_5, false=allTrue_6)
allTrue_7 = List.AllTrue(list=if_15)
string_28 = StringInput("HD2 is TRUE")
string_29 = StringInput("HD2 is FALSE")
if_16 = If(test=allTrue_7, true=string_28, false=string_29)
watch_13 = Watch(if_16)

views_2 = Views("QAFs Representation")
string_30 = StringInput("REGULARITY TYPE")

# group: import types properties from Excel
file_path = Filename(".\Regularity types table.xlsx")
file_from_path = FileObject(path=file_path)
code_block_26 = CodeBlock { "Sheet1"; }
importExcel = Data.ImportExcel(file=file_from_path, sheetName=code_block_26)

# group: Properties of the window set
join = List.Join(list0=if_12, list1=if_, list2=if_2, list3=if_4, list4=if_6, list5=if_14, list6=if_16, list7=if_11, list8=if_8, list9=if_9)

# group: Check for similarity with types
number_18 = DoubleInput(0)
list_getitematindex_type_names = List.GetItemAtIndex(list=importExcel@L2, index=number_18)
list_removeitematindex_type = List.RemoveItemAtIndex(list=importExcel@L2, indices=number_18)  # "List.RemoveItemAtIndex (Type Properties)"
equals = List.Equals(objectA=join, objectB=list_removeitematindex_type@L2)
filterByBoolMask = List.FilterByBoolMask(list=list_getitematindex_type_names, mask=equals)
watch_14 = Watch(filterByBoolMask.in)

string_from_object = FromObject(obj=watch_14)
setParameterByName = Element.SetParameterByName(element=views_2, parameterName=string_30, value=string_from_object)
