# Dynamo graph Symmetry-Based Balance Representation Script.dyn "Balance 10" (Dynamo 2.5.0.7460)
# packages: Clockwork for Dynamo 2.x 2.3.0

views = Views("QAFs Representation")
string = StringInput("BALANCE")

# group: Select Windows and Doors
categories = Categories("OST_Doors")
categories_2 = Categories("OST_Windows")
list_create = List.Create(item0=categories, item1=categories_2)
views_2 = Views("QAFs Representation")
all_elements_of_category_in_view = ElementsOfCategoryInView(Category=list_create, View=views_2)

# group: Remove Instances without TypeOfComponent value
elementType = Element.ElementType(element=all_elements_of_category_in_view)
string_2 = StringInput("TypeOfComponent")
getParameterValueByName = Element.GetParameterValueByName(element=elementType, parameterName=string_2)
string_3 = StringInput("")
ne = getParameterValueByName != string_3
filterByBoolMask = List.FilterByBoolMask(list=all_elements_of_category_in_view, mask=ne)

# group: Group Windows and Doors by Type and Level
string_4 = StringInput("Family and Type")
getParameterValueByName_2 = Element.GetParameterValueByName(element=filterByBoolMask.in, parameterName=string_4)
groupByKey = List.GroupByKey(list=filterByBoolMask.in@L2, keys=getParameterValueByName_2@L2)
string_5 = StringInput("Level")
getParameterValueByName_3 = Element.GetParameterValueByName(element=groupByKey.groups, parameterName=string_5)
groupByKey_2 = List.GroupByKey(list=groupByKey.groups@L2, keys=getParameterValueByName_3@L2)

# group: Sort Doors and Windows by X value
getLocation = Element.GetLocation(element=groupByKey_2.groups)
X = Point.X(point=getLocation)
sortByKey = List.SortByKey(list=groupByKey_2.groups@L2, keys=X@L2)

# group: Sorted X coords of Doors and Windows
getLocation_2 = Element.GetLocation(element=sortByKey.sorted_list)
X_2 = Point.X(point=getLocation_2)

# group: Select Stairs and Ramps
categories_3 = Categories("OST_Stairs")
categories_4 = Categories("OST_Ramps")
list_create_2 = List.Create(item0=categories_3, item1=categories_4)
views_3 = Views("QAFs Representation")
all_elements_of_category_in_view_2 = ElementsOfCategoryInView(Category=list_create_2, View=views_3)

# group: Remove Instances without TypeOfComponent value
elementType_2 = Element.ElementType(element=all_elements_of_category_in_view_2)
string_6 = StringInput("TypeOfComponent")
getParameterValueByName_4 = Element.GetParameterValueByName(element=elementType_2, parameterName=string_6)
string_7 = StringInput("")
ne_2 = getParameterValueByName_4 != string_7
filterByBoolMask_2 = List.FilterByBoolMask(list=all_elements_of_category_in_view_2, mask=ne_2)

# group: Group Stairs and Ramps by Type
string_8 = StringInput("Family and Type")
getParameterValueByName_5 = Element.GetParameterValueByName(element=filterByBoolMask_2.in, parameterName=string_8)
groupByKey_3 = List.GroupByKey(list=filterByBoolMask_2.in@L2, keys=getParameterValueByName_5@L2)
code_block = CodeBlock { 1; }
flatten = List.Flatten(list=groupByKey_3.groups, amt=code_block)

# group: Get centroid of stairs and ramps
boundingBox = Element.BoundingBox(element=flatten)
minPoint = BoundingBox.MinPoint(boundingBox=boundingBox)
X_3 = Point.X(point=minPoint)
maxPoint = BoundingBox.MaxPoint(boundingBox=boundingBox)
X_4 = Point.X(point=maxPoint)
xs = X_3 + X_4
code_block_2 = CodeBlock { 2; }
div = xs / code_block_2
Y = Point.Y(point=minPoint)
Y_2 = Point.Y(point=maxPoint)
ys = Y + Y_2
code_block_3 = CodeBlock { 2; }
div_2 = ys / code_block_3
Z = Point.Z(point=minPoint)
Z_2 = Point.Z(point=maxPoint)
zs = Z + Z_2
code_block_4 = CodeBlock { 2; }
div_3 = zs / code_block_4
byCoordinates = Point.ByCoordinates(x=div, y=div_2, z=div_3)

# group: Sorted X coords of Stairs and Ramps
X_5 = Point.X(point=byCoordinates)
sort = List.Sort(list=X_5)
flatten_2 = List.Flatten(list=sort@L2)

# group: Select Generic Models
categories_5 = Categories("OST_GenericModel")
views_4 = Views("QAFs Representation")
all_elements_of_category_in_view_3 = ElementsOfCategoryInView(Category=categories_5, View=views_4)

# group: Remove Instances without TypeOfComponent value
elementType_3 = Element.ElementType(element=all_elements_of_category_in_view_3)
string_9 = StringInput("TypeOfComponent")
getParameterValueByName_6 = Element.GetParameterValueByName(element=elementType_3, parameterName=string_9)
string_10 = StringInput("")
ne_3 = getParameterValueByName_6 != string_10
filterByBoolMask_3 = List.FilterByBoolMask(list=all_elements_of_category_in_view_3, mask=ne_3)

# group: Group Generic Models by TypeOfComponent
elementType_4 = Element.ElementType(element=filterByBoolMask_3.in)
string_11 = StringInput("TypeOfComponent")
getParameterValueByName_7 = Element.GetParameterValueByName(element=elementType_4, parameterName=string_11)
groupByKey_4 = List.GroupByKey(list=filterByBoolMask_3.in, keys=getParameterValueByName_7)

# group: Group Generic Models by Volume
geometry = Element.Geometry(element=groupByKey_4.groups)
volume = Solid.Volume(solid=geometry)
flatten_3 = List.Flatten(list=volume@L3)
code_block_5 = CodeBlock { 2; }
round = Math.Round(number=flatten_3, digits=code_block_5)
groupByKey_5 = List.GroupByKey(list=groupByKey_4.groups@L2, keys=round@L2)
code_block_6 = CodeBlock { 1; }
flatten_4 = List.Flatten(list=groupByKey_5.groups, amt=code_block_6)

# group: Get centroid of generic models
boundingBox_2 = Element.BoundingBox(element=flatten_4)
minPoint_2 = BoundingBox.MinPoint(boundingBox=boundingBox_2)
X_6 = Point.X(point=minPoint_2)
maxPoint_2 = BoundingBox.MaxPoint(boundingBox=boundingBox_2)
X_7 = Point.X(point=maxPoint_2)
xs_2 = X_6 + X_7
code_block_7 = CodeBlock { 2; }
div_4 = xs_2 / code_block_7
Y_3 = Point.Y(point=minPoint_2)
Y_4 = Point.Y(point=maxPoint_2)
ys_2 = Y_3 + Y_4
code_block_8 = CodeBlock { 2; }
div_5 = ys_2 / code_block_8
Z_3 = Point.Z(point=minPoint_2)
Z_4 = Point.Z(point=maxPoint_2)
zs_2 = Z_3 + Z_4
code_block_9 = CodeBlock { 2; }
div_6 = zs_2 / code_block_9
byCoordinates_2 = Point.ByCoordinates(x=div_4, y=div_5, z=div_6)

# group: Sorted X coords of Generic Models
X_8 = Point.X(point=byCoordinates_2)
sort_2 = List.Sort(list=X_8)
flatten_5 = List.Flatten(list=sort_2@L2)

# group: Select Model Groups
categories_6 = Categories("OST_IOSModelGroups")
views_5 = Views("QAFs Representation")
all_elements_of_category_in_view_4 = ElementsOfCategoryInView(Category=categories_6, View=views_5)

# group: Remove Instances without TypeOfComponent value
elementType_5 = Element.ElementType(element=all_elements_of_category_in_view_4)
string_12 = StringInput("TypeOfComponent")
getParameterValueByName_8 = Element.GetParameterValueByName(element=elementType_5, parameterName=string_12)
string_13 = StringInput("")
ne_4 = getParameterValueByName_8 != string_13
filterByBoolMask_4 = List.FilterByBoolMask(list=all_elements_of_category_in_view_4, mask=ne_4)

# group: Group Model Groups by Type and Level
string_14 = StringInput("Family and Type")
getParameterValueByName_9 = Element.GetParameterValueByName(element=filterByBoolMask_4.in, parameterName=string_14)
groupByKey_6 = List.GroupByKey(list=filterByBoolMask_4.in, keys=getParameterValueByName_9)
string_15 = StringInput("Reference Level")
getParameterValueByName_10 = Element.GetParameterValueByName(element=groupByKey_6.groups, parameterName=string_15)
groupByKey_7 = List.GroupByKey(list=groupByKey_6.groups@L2, keys=getParameterValueByName_10@L2)

# group: Sort Model Groups by X value
getLocation_3 = Element.GetLocation(element=groupByKey_7.groups)
X_9 = Point.X(point=getLocation_3)
sortByKey_2 = List.SortByKey(list=groupByKey_7.groups@L2, keys=X_9@L2)

# group: Sorted X coords of Model Groups
getLocation_4 = Element.GetLocation(element=sortByKey_2.sorted_list)
X_10 = Point.X(point=getLocation_4)
sort_3 = List.Sort(list=X_10)
flatten_6 = List.Flatten(list=sort_3@L2)

# group: Sorted X Coords of All Elements
join = List.Join(list0=X_2, list1=flatten_2, list2=flatten_5, list3=flatten_6)
isNull = Object.IsNull(obj=join)
not_ = Not(x=isNull)
filterByBoolMask_5 = List.FilterByBoolMask(list=join, mask=not_)
isEmpty = List.IsEmpty(list=filterByBoolMask_5.in@L2)
not_2 = Not(x=isEmpty)
filterByBoolMask_6 = List.FilterByBoolMask(list=filterByBoolMask_5.in, mask=not_2)

# group: X Coords of Mid between consequent elements.
number = DoubleInput(-1)
dropItems = List.DropItems(list=filterByBoolMask_6.in@L2, amount=number)
restOfItems = List.RestOfItems(list=filterByBoolMask_6.in@L2)
sub = restOfItems - dropItems
code_block_10 = CodeBlock(X=dropItems, Y=sub) { midX = X + (Y / 2); }

# group: Overall Axes (X coords)
list_create_3 = List.Create(item0=filterByBoolMask_6.in, item1=code_block_10)
flatten_7 = List.Flatten(list=list_create_3)
isNull_2 = Object.IsNull(obj=flatten_7)
not_3 = Not(x=isNull_2)
filterByBoolMask_7 = List.FilterByBoolMask(list=flatten_7, mask=not_3)
code_block_11 = CodeBlock { 1; }
round_2 = Math.Round(number=filterByBoolMask_7.in, digits=code_block_11)
uniqueItems = List.UniqueItems(list=round_2@L2)

# group: Final List of Axes to be tested (Removing similar axes)
flatten_8 = List.Flatten(list=uniqueItems)
sort_4 = List.Sort(list=flatten_8)
number_2 = DoubleInput(0)
removeItemAtIndex = List.RemoveItemAtIndex(list=sort_4, indices=number_2)
code_block_12 = CodeBlock { -1; }
dropItems_2 = List.DropItems(list=sort_4, amount=code_block_12)
sub_2 = removeItemAtIndex - dropItems_2
code_block_13 = CodeBlock { 100; }
join_2 = List.Join(list0=sub_2, list1=code_block_13)
code_block_14 = CodeBlock(x=join_2) { x>=0.15; }
filterByBoolMask_8 = List.FilterByBoolMask(list=sort_4, mask=code_block_14)

# group: Repeating Elements by the count of axes to compare to each axis
count = List.Count(list=filterByBoolMask_8.in@L1)
ofRepeatedItem = List.OfRepeatedItem(item=filterByBoolMask_6.in, amount=count)
number_3 = DoubleInput(1)
flatten_9 = List.Flatten(list=ofRepeatedItem, amt=number_3)
ofRepeatedItem_2 = List.OfRepeatedItem(item=filterByBoolMask_6.in, amount=count)
number_4 = DoubleInput(1)
flatten_10 = List.Flatten(list=ofRepeatedItem_2, amt=number_4)

# group: Filtering Elements ON BOTH SIDES OF AXES (within 0.15 threshold)
code_block_15 = CodeBlock { 0.15; }
add = filterByBoolMask_8.in + code_block_15
gt = filterByBoolMask_6.in@L2 > add@L1  # lacing=CrossProduct
sub_3 = filterByBoolMask_8.in - code_block_15
lt = filterByBoolMask_6.in@L2 < sub_3@L1  # lacing=CrossProduct

# group: Sorted Stairs and Ramps by X coords
X_11 = Point.X(point=byCoordinates)
sortByKey_3 = List.SortByKey(list=flatten@L2, keys=X_11@L2)

# group: Sorted Generic Models by X coords
X_12 = Point.X(point=byCoordinates_2)
sortByKey_4 = List.SortByKey(list=flatten_4@L2, keys=X_12@L2)

# group: List of All Elements (Remove Nulls and Empty Lists)
join_3 = List.Join(list0=sortByKey.sorted_list, list1=sortByKey_3.sorted_list, list2=sortByKey_4.sorted_list, list3=sortByKey_2.sorted_list)
isNull_3 = Object.IsNull(obj=join_3)
not_4 = Not(x=isNull_3)
filterByBoolMask_9 = List.FilterByBoolMask(list=join_3, mask=not_4)
isEmpty_2 = List.IsEmpty(list=filterByBoolMask_9.in@L2)
not_5 = Not(x=isEmpty_2)
filterByBoolMask_10 = List.FilterByBoolMask(list=filterByBoolMask_9.in, mask=not_5)

# group: Filter Symmetrical Elements
elementType_6 = Element.ElementType(element=filterByBoolMask_10.in)
code_block_16 = CodeBlock { "Symmetrical"; }
getParameterValueByName_11 = Element.GetParameterValueByName(element=elementType_6, parameterName=code_block_16)
code_block_17 = CodeBlock { 1; }
eq = getParameterValueByName_11@L2 == code_block_17
filterByBoolMask_11 = List.FilterByBoolMask(list=filterByBoolMask_6.in, mask=eq)

# group: Filtering Elements ON AXES (within 0.15 threshold)
sub_4 = filterByBoolMask_11.in - filterByBoolMask_8.in  # lacing=CrossProduct
abs = Math.Abs(number=sub_4)
code_block_18 = CodeBlock { 0.15; }
le = abs <= code_block_18

# group: ReGroup Elements Coords According to each Axis
transpose = List.Transpose(lists=gt)
transpose_2 = List.Transpose(lists=lt)
list_transpose_elements_on_each = List.Transpose(lists=le)  # "List.Transpose (Elements ON EACH AXIS)"

# group: Elements Coords on Right and Left-side of Axes
list_filterbyboolmask_greater = List.FilterByBoolMask(list=flatten_9, mask=transpose)
list_filterbyboolmask_less = List.FilterByBoolMask(list=flatten_10, mask=transpose_2)

count_2 = List.Count(list=list_filterbyboolmask_greater.in@@L2)
count_3 = List.Count(list=list_filterbyboolmask_less.in@@L2)
ge = count_2 >= count_3
list_filterbyboolmask_greater_2 = List.FilterByBoolMask(list=list_filterbyboolmask_greater.in, mask=ge)  # "List.FilterByBoolMask (Greater Yes)"
not_6 = Not(x=ge)
list_filterbyboolmask_less_yes = List.FilterByBoolMask(list=list_filterbyboolmask_less.in, mask=not_6)
list_join_yes = List.Join(list0=list_filterbyboolmask_greater_2.in, list1=list_filterbyboolmask_less_yes.in)
isEmpty_3 = List.IsEmpty(list=list_join_yes@@L3)
not_7 = Not(x=isEmpty_3)
list_filterbyboolmask_yes = List.FilterByBoolMask(list=list_join_yes, mask=not_7)
reverse = List.Reverse(list=list_filterbyboolmask_yes.in@@L2)
list_filterbyboolmask_less_no = List.FilterByBoolMask(list=list_filterbyboolmask_less.in, mask=ge)
list_filterbyboolmask_greater_no = List.FilterByBoolMask(list=list_filterbyboolmask_greater.in, mask=not_6)
list_join_no = List.Join(list0=list_filterbyboolmask_less_no.in, list1=list_filterbyboolmask_greater_no.in)
isEmpty_4 = List.IsEmpty(list=list_join_no@@L3)
not_8 = Not(x=isEmpty_4)
list_filterbyboolmask_no = List.FilterByBoolMask(list=list_join_no, mask=not_8)
watch = Watch(list_filterbyboolmask_no.in)

# group: Mirroring Right-side Elements and Comparing Mirrored Elements with Left-side Elements (Threshold 0.35)
code_block_19 = CodeBlock { 2; }
mul = filterByBoolMask_8.in * code_block_19
list_create_4 = List.Create(item0=mul)
greater_coords_after_mirror = list_create_4@L1 - reverse@L3  # lacing=Longest
sub_5 = greater_coords_after_mirror - watch
abs_2 = Math.Abs(number=sub_5)
code_block_20 = CodeBlock { 0.35; }
le_2 = abs_2 <= code_block_20

# group: (X coords) Count of Elements Symmetrical around Each Axis
countTrue = List.CountTrue(list=le_2@L3)
code_block_21 = CodeBlock(X=countTrue) { X*2; }

# group: (X coords) Count of Element ON AXES
countTrue_2 = List.CountTrue(list=list_transpose_elements_on_each@L3)

# group: Zero-out the count of elements ON AXIS when there is not elements symmetrical AROUND AXIS
code_block_22 = CodeBlock { 0; }
ne_5 = code_block_21 != code_block_22
code_block_23 = CodeBlock { 0; }
if_ = If(test=ne_5, true=countTrue_2, false=code_block_23)

# group: Count of Elements on and symmetrical around each axis
count_of_elements_on_and_around = code_block_21 + if_  # "+ (Count of Elements on and around each axis)"; lacing=Longest
list_chop_تقسيم_القوائم_إلى = List.Chop(list=count_of_elements_on_and_around, lengths=count)  # "List.Chop (تقسيم القوائم إلى قائمة فرعية لكل محور)"
sum = Math.Sum(values=list_chop_تقسيم_القوائم_إلى)

# group: X coords of the Main Axis (with heighst symmetrical elements).
sortByKey_5 = List.SortByKey(list=filterByBoolMask_8.in, keys=sum)
reverse_2 = List.Reverse(list=sortByKey_5.sorted_list)
code_block_24 = CodeBlock { 0; }
getItemAtIndex = List.GetItemAtIndex(list=reverse_2, index=code_block_24)

reverse_3 = List.Reverse(list=filterByBoolMask_10.in@@L2)

# group: All Elements
watch_all_elements_without_nulls = Watch(reverse_3)

# group: Index of the Main AXIS
maximumItem = List.MaximumItem(list=sum)
indexOf = List.IndexOf(list=sum, element=maximumItem)

# group: Elements symmetrical around the MAIN AXIS
getItemAtIndex_2 = List.GetItemAtIndex(list=le_2@L4, index=indexOf)
flatten_11 = List.Flatten(list=getItemAtIndex_2@L2)
filterByBoolMask_12 = List.FilterByBoolMask(list=watch_all_elements_without_nulls, mask=flatten_11)

# group: Separate groups and non groups
category = Custom[Element.Category+](element=filterByBoolMask_12.in@L1)  # package Clockwork for Dynamo 2.x; Returns the category of a given element. Unlike the OOTB node Element.GetCategory, it will work for subcategories, families, family documents, schedules, subcategories and graphics styles as well.
categories_7 = Categories("OST_IOSModelGroups")
list_equals_is_group = List.Equals(objectA=category.category@L1, objectB=categories_7)
list_filterbyboolmask_filtered = List.FilterByBoolMask(list=filterByBoolMask_12.in@L1, mask=list_equals_is_group@L1)  # "List.FilterByBoolMask (filtered groups)"
members = Custom[Group.Members](group=list_filterbyboolmask_filtered.in)  # package Clockwork for Dynamo 2.x; Retrieves the members of a group
not_9 = Not(x=list_equals_is_group)
list_filterbyboolmask_not_groups = List.FilterByBoolMask(list=filterByBoolMask_12.in@L1, mask=not_9@L1)
join_4 = List.Join(list0=members, list1=list_filterbyboolmask_not_groups.in)

# group: Removing Nulls to get Elements Around the Main Axis Bounding Boxes
elementType_7 = Element.ElementType(element=join_4)
isNull_4 = Object.IsNull(obj=elementType_7)
not_10 = Not(x=isNull_4)
filterByBoolMask_13 = List.FilterByBoolMask(list=join_4, mask=not_10)
name = Element.Name(element=filterByBoolMask_13.in)
code_block_25 = CodeBlock { "Dimension"; }
contains = String.Contains(str=name@L3, searchFor=code_block_25)
not_11 = Not(x=contains)
filterByBoolMask_14 = List.FilterByBoolMask(list=filterByBoolMask_13.in@L2, mask=not_11@L2)
boundingBox_3 = Element.BoundingBox(element=filterByBoolMask_14.in)
flatten_12 = List.Flatten(list=boundingBox_3)
isNull_5 = Object.IsNull(obj=flatten_12)
not_12 = Not(x=isNull_5)
filterByBoolMask_15 = List.FilterByBoolMask(list=flatten_12, mask=not_12)

# group: Polygon of Symmetrical Elements Around the Main Axis (Mirrored)
maxPoint_3 = BoundingBox.MaxPoint(boundingBox=filterByBoolMask_15.in)
point_x_max = Point.X(point=maxPoint_3)
code_block_26 = CodeBlock(axisX=getItemAtIndex, x=point_x_max) { 2 * axisX - x; }
minPoint_3 = BoundingBox.MinPoint(boundingBox=filterByBoolMask_15.in)
point_z_min = Point.Z(point=minPoint_3)
point_bycoordinates_minx_minz = Point.ByCoordinates(x=code_block_26, z=point_z_min)
point_x_min = Point.X(point=minPoint_3)
code_block_27 = CodeBlock(axisX=getItemAtIndex, x=point_x_min) { 2 * axisX - x; }
point_bycoordinates_maxx_minz = Point.ByCoordinates(x=code_block_27, z=point_z_min)
point_z_max = Point.Z(point=maxPoint_3)
point_bycoordinates_maxx_maxz = Point.ByCoordinates(x=code_block_27, z=point_z_max)
point_bycoordinates_minx_maxz = Point.ByCoordinates(x=code_block_26, z=point_z_max)
list_create_5 = List.Create(item0=point_bycoordinates_minx_minz, item1=point_bycoordinates_maxx_minz, item2=point_bycoordinates_maxx_maxz, item3=point_bycoordinates_minx_maxz)
transpose_3 = List.Transpose(lists=list_create_5)
boolean = BoolSelector(true)
byPoints = PolyCurve.ByPoints(points=transpose_3, connectLastToFirst=boolean)

# group: Polygon of Symmetrical Elements Around the Main Axis
minPoint_4 = BoundingBox.MinPoint(boundingBox=filterByBoolMask_15.in)
point_x_min_2 = Point.X(point=minPoint_4)
point_z_min_2 = Point.Z(point=minPoint_4)
point_bycoordinates_minx_minz_2 = Point.ByCoordinates(x=point_x_min_2, z=point_z_min_2)
maxPoint_4 = BoundingBox.MaxPoint(boundingBox=filterByBoolMask_15.in)
point_x_max_2 = Point.X(point=maxPoint_4)
point_bycoordinates_maxx_minz_2 = Point.ByCoordinates(x=point_x_max_2, z=point_z_min_2)
point_z_max_2 = Point.Z(point=maxPoint_4)
point_bycoordinates_maxx_maxz_2 = Point.ByCoordinates(x=point_x_max_2, z=point_z_max_2)
point_bycoordinates_minx_maxz_2 = Point.ByCoordinates(x=point_x_min_2, z=point_z_max_2)
list_create_6 = List.Create(item0=point_bycoordinates_minx_minz_2, item1=point_bycoordinates_maxx_minz_2, item2=point_bycoordinates_maxx_maxz_2, item3=point_bycoordinates_minx_maxz_2)
transpose_4 = List.Transpose(lists=list_create_6)
boolean_2 = BoolSelector(true)
byPoints_2 = PolyCurve.ByPoints(points=transpose_4, connectLastToFirst=boolean_2)

# group: Remove polycurves of ON AXIS elements when everything is ZERO
code_block_28 = CodeBlock { 0; }
count_of_elements_around_and_on = Watch(sum)  # "Count Of Elements Around and On each axis"
eq_2 = code_block_28@L1 == count_of_elements_around_and_on
allTrue = List.AllTrue(list=eq_2)
code_block_29 = CodeBlock { 10000; }
if_2 = If(test=allTrue, true=code_block_29, false=indexOf)

# group: Elements ON MAIN AXIS
getItemAtIndex_3 = List.GetItemAtIndex(list=list_transpose_elements_on_each@L4, index=if_2)
flatten_13 = List.Flatten(list=getItemAtIndex_3@L2)
filterByBoolMask_16 = List.FilterByBoolMask(list=watch_all_elements_without_nulls, mask=flatten_13)
flatten_14 = List.Flatten(list=filterByBoolMask_16.in)

# group: Separate groups and non groups
category_2 = Custom[Element.Category+](element=flatten_14@L1)
categories_8 = Categories("OST_IOSModelGroups")
list_equals_is_group_2 = List.Equals(objectA=category_2.category@L1, objectB=categories_8)
list_filterbyboolmask_filtered_2 = List.FilterByBoolMask(list=flatten_14@L1, mask=list_equals_is_group_2@L1)  # "List.FilterByBoolMask (filtered groups)"
members_2 = Custom[Group.Members](group=list_filterbyboolmask_filtered_2.in)
not_13 = Not(x=list_equals_is_group_2)
list_filterbyboolmask_not_groups_2 = List.FilterByBoolMask(list=flatten_14@L1, mask=not_13@L1)
join_5 = List.Join(list0=members_2, list1=list_filterbyboolmask_not_groups_2.in)

# group: Removing Nulls to get Elements on the Main Axis Bounding Boxes
elementType_8 = Element.ElementType(element=join_5)
isNull_6 = Object.IsNull(obj=elementType_8)
not_14 = Not(x=isNull_6)
filterByBoolMask_17 = List.FilterByBoolMask(list=join_5, mask=not_14)
name_2 = Element.Name(element=filterByBoolMask_17.in)
code_block_30 = CodeBlock { "Dimension"; }
contains_2 = String.Contains(str=name_2@L3, searchFor=code_block_30)
not_15 = Not(x=contains_2)
filterByBoolMask_18 = List.FilterByBoolMask(list=filterByBoolMask_17.in@L2, mask=not_15@L2)
boundingBox_4 = Element.BoundingBox(element=filterByBoolMask_18.in)
flatten_15 = List.Flatten(list=boundingBox_4)
isNull_7 = Object.IsNull(obj=flatten_15)
not_16 = Not(x=isNull_7)
filterByBoolMask_19 = List.FilterByBoolMask(list=flatten_15, mask=not_16)

# group: Polygon of Symmetrical Elements on the Main Axis
minPoint_5 = BoundingBox.MinPoint(boundingBox=filterByBoolMask_19.in)
point_x_min_3 = Point.X(point=minPoint_5)
point_z_min_3 = Point.Z(point=minPoint_5)
point_bycoordinates_minx_minz_3 = Point.ByCoordinates(x=point_x_min_3, z=point_z_min_3)
maxPoint_5 = BoundingBox.MaxPoint(boundingBox=filterByBoolMask_19.in)
point_x_max_3 = Point.X(point=maxPoint_5)
point_bycoordinates_maxx_minz_3 = Point.ByCoordinates(x=point_x_max_3, z=point_z_min_3)
point_z_max_3 = Point.Z(point=maxPoint_5)
point_bycoordinates_maxx_maxz_3 = Point.ByCoordinates(x=point_x_max_3, z=point_z_max_3)
point_bycoordinates_minx_maxz_3 = Point.ByCoordinates(x=point_x_min_3, z=point_z_max_3)
list_create_7 = List.Create(item0=point_bycoordinates_minx_minz_3, item1=point_bycoordinates_maxx_minz_3, item2=point_bycoordinates_maxx_maxz_3, item3=point_bycoordinates_minx_maxz_3)
transpose_5 = List.Transpose(lists=list_create_7)
boolean_3 = BoolSelector(true)
byPoints_3 = PolyCurve.ByPoints(points=transpose_5, connectLastToFirst=boolean_3)

# group: Total Area of Symmetrical Elements
byPatch = Surface.ByPatch(closedCurve=byPoints)
byPatch_2 = Surface.ByPatch(closedCurve=byPoints_2)
byPatch_3 = Surface.ByPatch(closedCurve=byPoints_3)
list_create_8 = List.Create(item0=byPatch, item1=byPatch_2, item2=byPatch_3)
flatten_16 = List.Flatten(list=list_create_8)
isNull_8 = Object.IsNull(obj=flatten_16)
not_17 = Not(x=isNull_8)
filterByBoolMask_20 = List.FilterByBoolMask(list=flatten_16, mask=not_17)
code_block_31 = CodeBlock { 0.3; }
thicken = Surface.Thicken(surface=filterByBoolMask_20.in, thickness=code_block_31)
byUnion = Solid.ByUnion(solids=thicken)
explode = Geometry.Explode(geometry=byUnion)
code_block_32 = CodeBlock { 0.1; }
normalAtParameter = Surface.NormalAtParameter(surface=explode, u=code_block_32, v=code_block_32)
YAxis = Vector.YAxis()
dot = Vector.Dot(vector=normalAtParameter, vec=YAxis)
abs_3 = Math.Abs(number=dot)
code_block_33 = CodeBlock { 1; }
eq_3 = abs_3 == code_block_33
filterByBoolMask_21 = List.FilterByBoolMask(list=explode, mask=eq_3)
area = Surface.Area(surface=filterByBoolMask_21.in)
sum_2 = Math.Sum(values=area)
code_block_34 = CodeBlock { 2; }
div_7 = sum_2 / code_block_34

# group: Separate groups and non groups
category_3 = Custom[Element.Category+](element=watch_all_elements_without_nulls@L1)
categories_9 = Categories("OST_IOSModelGroups")
list_equals_is_group_3 = List.Equals(objectA=category_3.category@L1, objectB=categories_9)
list_filterbyboolmask_filtered_3 = List.FilterByBoolMask(list=watch_all_elements_without_nulls@L1, mask=list_equals_is_group_3@L1)  # "List.FilterByBoolMask (filtered groups)"
members_3 = Custom[Group.Members](group=list_filterbyboolmask_filtered_3.in)
not_18 = Not(x=list_equals_is_group_3)
list_filterbyboolmask_not_groups_3 = List.FilterByBoolMask(list=watch_all_elements_without_nulls@L1, mask=not_18@L1)
join_6 = List.Join(list0=members_3, list1=list_filterbyboolmask_not_groups_3.in)

# group: Removing Nulls to get All Elements Bounding Boxes
elementType_9 = Element.ElementType(element=join_6)
isNull_9 = Object.IsNull(obj=elementType_9)
not_19 = Not(x=isNull_9)
filterByBoolMask_22 = List.FilterByBoolMask(list=join_6, mask=not_19)
name_3 = Element.Name(element=filterByBoolMask_22.in)
code_block_35 = CodeBlock { "Dimension"; }
contains_3 = String.Contains(str=name_3@L3, searchFor=code_block_35)
not_20 = Not(x=contains_3)
filterByBoolMask_23 = List.FilterByBoolMask(list=filterByBoolMask_22.in@L2, mask=not_20@L2)
boundingBox_5 = Element.BoundingBox(element=filterByBoolMask_23.in)
flatten_17 = List.Flatten(list=boundingBox_5)
isNull_10 = Object.IsNull(obj=flatten_17)
not_21 = Not(x=isNull_10)
filterByBoolMask_24 = List.FilterByBoolMask(list=flatten_17, mask=not_21)

# group: Polygon of the Facade
minPoint_6 = BoundingBox.MinPoint(boundingBox=filterByBoolMask_24.in)
point_x_min_4 = Point.X(point=minPoint_6)
code_block_36 = CodeBlock { 20; }
point_z_min_4 = Point.Z(point=minPoint_6)
point_bycoordinates_minx_minz_4 = Point.ByCoordinates(x=point_x_min_4, y=code_block_36, z=point_z_min_4)
maxPoint_6 = BoundingBox.MaxPoint(boundingBox=filterByBoolMask_24.in)
point_x_max_4 = Point.X(point=maxPoint_6)
point_bycoordinates_maxx_minz_4 = Point.ByCoordinates(x=point_x_max_4, y=code_block_36, z=point_z_min_4)
point_z_max_4 = Point.Z(point=maxPoint_6)
point_bycoordinates_maxx_maxz_4 = Point.ByCoordinates(x=point_x_max_4, y=code_block_36, z=point_z_max_4)
point_bycoordinates_minx_maxz_4 = Point.ByCoordinates(x=point_x_min_4, y=code_block_36, z=point_z_max_4)
list_create_9 = List.Create(item0=point_bycoordinates_minx_minz_4, item1=point_bycoordinates_maxx_minz_4, item2=point_bycoordinates_maxx_maxz_4, item3=point_bycoordinates_minx_maxz_4)
transpose_6 = List.Transpose(lists=list_create_9)
boolean_4 = BoolSelector(true)
byPoints_4 = PolyCurve.ByPoints(points=transpose_6, connectLastToFirst=boolean_4)

# group: Total Area of Symmetrical Elements
byPatch_4 = Surface.ByPatch(closedCurve=byPoints_4)
code_block_37 = CodeBlock { 0.3; }
thicken_2 = Surface.Thicken(surface=byPatch_4, thickness=code_block_37)
byUnion_2 = Solid.ByUnion(solids=thicken_2)
explode_2 = Geometry.Explode(geometry=byUnion_2)
code_block_38 = CodeBlock { 0.1; }
normalAtParameter_2 = Surface.NormalAtParameter(surface=explode_2, u=code_block_38, v=code_block_38)
YAxis_2 = Vector.YAxis()
dot_2 = Vector.Dot(vector=normalAtParameter_2, vec=YAxis_2)
abs_4 = Math.Abs(number=dot_2)
code_block_39 = CodeBlock { 1; }
eq_4 = abs_4 == code_block_39
filterByBoolMask_25 = List.FilterByBoolMask(list=explode_2, mask=eq_4)
area_2 = Surface.Area(surface=filterByBoolMask_25.in)
sum_3 = Math.Sum(values=area_2)
code_block_40 = CodeBlock { 2; }
div_8 = sum_3 / code_block_40

# group: SYMM PERC.
div_9 = div_7 / div_8
isNull_11 = Object.IsNull(obj=div_9)
not_22 = Not(x=isNull_11)
filterByBoolMask_26 = List.FilterByBoolMask(list=div_9, mask=not_22)
sum_4 = Math.Sum(values=filterByBoolMask_26.in)
isNull_12 = Object.IsNull(obj=sum_4)
code_block_41 = CodeBlock { 0; }
if_3 = If(test=isNull_12, true=code_block_41, false=sum_4)
watch_2 = Watch(if_3)
balance = CodeBlock(BAL=watch_2) { BAL*100; }

setParameterByName = Element.SetParameterByName(element=views, parameterName=string, value=balance)
watch_3 = Watch(filterByBoolMask_14.in)

# group: List of All Elements (Remove Nulls and Empty Lists)
join_7 = List.Join(list0=sortByKey.sorted_list, list1=sortByKey_3.sorted_list, list2=sortByKey_4.sorted_list, list3=sortByKey_2.sorted_list)
isNull_13 = Object.IsNull(obj=join_7)
not_23 = Not(x=isNull_13)
filterByBoolMask_27 = List.FilterByBoolMask(list=join_7, mask=not_23)
isEmpty_5 = List.IsEmpty(list=filterByBoolMask_27.in@L2)
not_24 = Not(x=isEmpty_5)
filterByBoolMask_28 = List.FilterByBoolMask(list=filterByBoolMask_27.in, mask=not_24)

watch_4 = Watch(list_filterbyboolmask_greater_2.in)
watch_5 = Watch(list_filterbyboolmask_greater_no.in)
watch_6 = Watch(list_filterbyboolmask_less_yes.in)
watch_7 = Watch(list_filterbyboolmask_less_no.in)
code_block_42 = CodeBlock { -1; }
byCoordinates_3 = Point.ByCoordinates(x=getItemAtIndex, z=code_block_42)
maximumItem_2 = List.MaximumItem(list=point_z_max_4)
code_block_43 = CodeBlock(x=maximumItem_2) { x+1; }
byCoordinates_4 = Point.ByCoordinates(x=getItemAtIndex, z=code_block_43)
byStartPointEndPoint = Line.ByStartPointEndPoint(startPoint=byCoordinates_3, endPoint=byCoordinates_4)
